# Grasshopper definition 001Flower.gh (Grasshopper 1.0.8)
# plug-ins: LunchBox

range = Range(Domain=Domain(0, 1), Steps=Slider(9, range=0..100))
gene_pool = GenePool(Decimals=3, Maximum=1, Minimum=0, Value=[0, 0.337, 0.667, 1])
gene_pool_2 = GenePool(Decimals=3, Maximum=20, Minimum=0, Value=[1.078, 0.636, 0.553, 0.29])
graph_mapper = GraphMapper(
    range,
    x0=0,
    x1=1,
    y0=0,
    y1=1,
    container_name="Bezier",
    cpx=[0, 0.2878359854, 0.6623923779, 1],
    cpy=[0, 0.5487285852, 0.9120525122, 0.4779928327])
plane = Plane(PlaneXY(0, 0, 0))
multiplication = Multiplication(A=range, B=Slider(8.264, range=0..20))
curve = Curve(reparameterize(<curve referenced from the Rhino model>))
triangular = Triangular(Plane=plane, Size=1, ExtentX=Slider(26, range=0..100), ExtentY=Slider(13, range=0..100))  # -> flatten(Cells), Points
pipe_variable = PipeVariable(Curve=curve, Parameters=gene_pool, Radii=gene_pool_2, Caps=0)
addition = Addition(A=Slider(2.349, range=0..20), B=multiplication)
graph_mapper_2 = GraphMapper(
    range,
    x0=0,
    x1=1,
    y0=0,
    y1=1,
    container_name="Bezier",
    cpx=[0, 0.1560528874, 1, 1],
    cpy=[0.4085255265, 0.6267151833, 0.9848820567, 0.07936429977])
bounding_box = BoundingBox(Content=triangular.Cells, Plane=PlaneXY(0, 0, 0), UnionBox=True)  # -> Box, Box_2
map_to_surface = MapToSurface(Curve=triangular.Cells, Source=bounding_box.Box, Target=pipe_variable)
multiplication_2 = Multiplication(A=graph_mapper, B=Slider(5.439, range=0..20))
construct_point = ConstructPoint(XCoordinate=0, YCoordinate=addition, ZCoordinate=multiplication_2)
explode = Explode(Curve=map_to_surface, Recursive=True)  # -> Segments, Vertices
expression = Expression(x=graph_mapper_2, y=Slider(0.297, range=0..2), Expression="pi/2*x*y")
explode_2 = Explode(Curve=explode.Segments, Recursive=True)  # -> Segments, Vertices
cull_index = CullIndex(List=explode.Vertices, Indices="-1", Wrap=True)
number_slider = Slider(10, range=0..20)
number_slider_2 = Slider(0.552, range=0..1)
average = Average(Input=cull_index)
average_2 = Average(Input=explode_2.Vertices)
rotate_3d = Rotate3D(Geometry=construct_point, Angle=expr("-x", expression), Center=Point(0, 0, 0), Axis=Vector(0, 0, 1))  # -> Geometry, Transform
rotate = Rotate(Geometry=construct_point, Angle=expression, Plane=PlaneXY(0, 0, 0))  # -> Geometry, Transform
expression_2 = Expression(x=Slider(1, range=0..1), Expression="2*π*x")
curve_closest_point = CurveClosestPoint(Point=average, Curve=curve)  # -> Point, Parameter, Distance
surface_closest_point = SurfaceClosestPoint(Point=average, Surface=pipe_variable)  # -> Point, UVPoint, Distance
shift_paths = ShiftPaths(Data=average_2, Offset=-1)
construct_domain = ConstructDomain(DomainStart=number_slider_2, DomainEnd=number_slider_2)
interpolate = Interpolate(Vertices=construct_point, Degree=3, Periodic=False, KnotStyle=1)  # -> Curve, Length, Domain
interpolate_2 = Interpolate(Vertices=rotate.Geometry, Degree=3, Periodic=False, KnotStyle=1)  # -> Curve, Length, Domain
interpolate_3 = Interpolate(Vertices=rotate_3d.Geometry, Degree=3, Periodic=False, KnotStyle=1)  # -> Curve, Length, Domain
range_2 = Range(Domain=expression_2, Steps=number_slider)
construct_domain_2 = ConstructDomain(DomainStart=Slider(0.103, range=0..1), DomainEnd=Slider(0.273, range=0..1))
bounds = Bounds(Numbers=flatten(curve_closest_point.Distance))
line = Line(StartPoint=average, EndPoint=shift_paths)
evaluate_surface = EvaluateSurface(Surface=pipe_variable, Point=surface_closest_point.UVPoint)  # -> Point, Normal, UDirection, VDirection, Frame
plane_2 = Plane(PlaneXY(0, 0, 0))
remap_numbers = RemapNumbers(Value=curve_closest_point.Distance, Source=bounds, Target=construct_domain_2)  # -> Mapped, Clipped
loft = Loft(
    Curves=[interpolate_2.Curve, interpolate.Curve, interpolate_3.Curve],
    Options={Adjust=False, Closed=False, LoftEnds=0, LoftSimp=0, LoftType=0, Rebuild=10, Refit=0.01})
number_slider_3 = Slider(0.1, range=0..10)
evaluate_curve = EvaluateCurve(Curve=reparameterize(line), Parameter=remap_numbers.Mapped)  # -> Point, Tangent, Angle
deconstruct_plane = DeconstructPlane(Plane=evaluate_surface.Frame)  # -> Origin, XAxis, YAxis, ZAxis
rotate_2 = Rotate(Geometry=loft, Angle=range_2, Plane=plane_2)  # -> Geometry, Transform
range_3 = Range(Domain=construct_domain, Steps=number_slider)
line_2 = Line(StartPoint=explode_2.Vertices, EndPoint=graft(evaluate_curve.Point))
negative = Negative(Value=number_slider_3)
plane_3 = Plane(PlaneXY(0, 0, 0))
space_truss_structure_1 = SpaceTrussStructure1(
    Surface=rotate_2.Geometry,
    UDivisions=Slider(4, range=0..100),
    VDivisions=Slider(9, range=0..100),
    TrussDepth=Slider(0.4, range=0..1))  # -> PrimaryLines, PrimaryLines_2, WebLines, StructureNodes
amplitude = Amplitude(Vector=deconstruct_plane.ZAxis, Amplitude=[number_slider_3, negative])
shift_paths_2 = ShiftPaths(Data=line_2, Offset=-1)
scale_nu = ScaleNU(Geometry=rotate_2.Geometry, Plane=plane_3, ScaleX=range_3, ScaleY=range_3, ScaleZ=1)  # -> Geometry, Transform
join_curves = JoinCurves(Curves=shift_paths_2, Preserve=False)
move = Move(Geometry=average, Motion=amplitude)  # -> Geometry, Transform
extrude_point = ExtrudePoint(Base=join_curves, Point=move.Geometry)
scale_nu_2 = ScaleNU(Geometry=scale_nu.Geometry, Plane=PlaneXY(0, 0, 0), ScaleX=1, ScaleY=1, ScaleZ=Slider(1.361, range=0..5))  # -> Geometry, Transform
colour_picker = ColourPicker(PickedColour=RGB(207, 169, 31))
plane_4 = Plane(PlaneXY(0, 0, 0))
rotate_3 = Rotate(Geometry=scale_nu_2.Geometry, Angle=1.570796327, Plane=plane_4)  # -> Geometry, Transform
custom_preview = CustomPreview(Geometry=extrude_point, Material=colour_picker)
scale_nu_3 = ScaleNU(Geometry=rotate_3.Geometry, Plane=PlaneXY(0, 0, 0), ScaleX=range_3, ScaleY=range_3, ScaleZ=1)  # -> Geometry, Transform
space_truss_structure_1_2 = SpaceTrussStructure1(
    Surface=rotate_3.Geometry,
    UDivisions=Slider(3, range=0..100),
    VDivisions=Slider(7, range=0..100),
    TrussDepth=Slider(0.25, range=0..1))  # -> PrimaryLines, PrimaryLines_2, WebLines, StructureNodes
plane_5 = Plane(PlaneXY(0, 0, 0))
rotate_4 = Rotate(Geometry=scale_nu_3.Geometry, Angle=1.570796327, Plane=plane_5)  # -> Geometry, Transform
plane_6 = Plane(PlaneXY(0, 0, 0))
scale_nu_4 = ScaleNU(Geometry=rotate_4.Geometry, Plane=plane_6, ScaleX=1, ScaleY=1, ScaleZ=Slider(1.35, range=0..10))  # -> Geometry, Transform
space_truss_structure_1_3 = SpaceTrussStructure1(
    Surface=scale_nu_4.Geometry,
    UDivisions=Slider(1, range=0..100),
    VDivisions=Slider(8, range=0..100),
    TrussDepth=Slider(0.15, range=0..1))  # -> PrimaryLines, PrimaryLines_2, WebLines, StructureNodes
curve_2 = Curve([space_truss_structure_1.PrimaryLines, space_truss_structure_1.PrimaryLines_2, space_truss_structure_1.WebLines])
curve_3 = Curve([space_truss_structure_1_2.PrimaryLines, space_truss_structure_1_2.PrimaryLines_2, space_truss_structure_1_2.WebLines])
curve_4 = Curve([space_truss_structure_1_3.PrimaryLines, space_truss_structure_1_3.PrimaryLines_2, space_truss_structure_1_3.WebLines])
pipe = Pipe(Curve=curve_2, Radius=Slider(0.09, range=0..1), Caps="2")
pipe_2 = Pipe(Curve=curve_3, Radius=Slider(0.07, range=0..1), Caps="2")
pipe_3 = Pipe(Curve=curve_4, Radius=Slider(0.05, range=0..1), Caps="2")
colour_picker_2 = ColourPicker(PickedColour=RGB(56, 110, 110))
colour_picker_3 = ColourPicker(PickedColour=RGB(100, 178, 96))
colour_picker_4 = ColourPicker(PickedColour=RGB(0, 255, 166))
custom_preview_2 = CustomPreview(Geometry=pipe, Material=colour_picker_2)
custom_preview_3 = CustomPreview(Geometry=pipe_2, Material=colour_picker_3)
custom_preview_4 = CustomPreview(Geometry=pipe_3, Material=colour_picker_4)
