# Grasshopper definition 002VoronoiCube.gh (Grasshopper 1.0.8)
# plug-ins: Weaverbird

center_box = CenterBox(Base=PlaneXY(0, 0, 0), X=5, Y=5, Z=5)
populate_3d = Populate3D(Region=center_box, Count=Slider(26, range=0..100), Seed=1)
voronoi_3d = Voronoi3D(Points=populate_3d)  # -> Cells, Boundary
deconstruct_brep = DeconstructBrep(Brep=voronoi_3d.Cells)  # -> Faces, Edges, Vertices
area = Area(Geometry=voronoi_3d.Cells)  # -> Area, Centroid
area_2 = Area(Geometry=deconstruct_brep.Faces)  # -> Area, Centroid
scale = Scale(Geometry=voronoi_3d.Cells, Center=area.Centroid, Factor=Slider(0.33, range=0..1))  # -> Geometry, Transform
scale_2 = Scale(Geometry=deconstruct_brep.Faces, Center=area_2.Centroid, Factor=Slider(0.3, range=0..1))  # -> Geometry, Transform
deconstruct_brep_2 = DeconstructBrep(Brep=scale.Geometry)  # -> Faces, Edges, Vertices
deconstruct_brep_3 = DeconstructBrep(Brep=scale_2.Geometry)  # -> Faces, Edges, Vertices
deconstruct_brep_4 = DeconstructBrep(Brep=deconstruct_brep_2.Faces)  # -> Faces, Edges, Vertices
ruled_surface = RuledSurface(CurveA=deconstruct_brep_3.Edges, CurveB=deconstruct_brep_4.Edges)
simple_mesh = SimpleMesh(Brep=ruled_surface)  # -> flatten(Mesh)
mesh_join = MeshJoin(Meshes=simple_mesh)
weaverbird_s_mesh_thicken = WeaverbirdsMeshThicken(MeshCurves=mesh_join, Distance=Slider(0.456, range=0..1), OffsetType=0)
weaverbird_s_catmull_clark_subdivision = WeaverbirdsCatmullClarkSubdivision(MeshCurves=weaverbird_s_mesh_thicken, Level=Slider(3, range=0..10), SmoothNakedEdges=1)
custom_preview = CustomPreview(Geometry=weaverbird_s_catmull_clark_subdivision, Material=ColourSwatch(SwatchColor=RGB(60, 137, 166)))
