# Grasshopper definition 003G.Vector.gh (Grasshopper 1.0.8)

square = Square(Plane=PlaneXY(0, 0, 0), Size=1, ExtentX=Slider(20, range=0..100), ExtentY=Slider(20, range=0..100))  # -> Cells, Points
point = Point(Point(15.14058955, 18.9454288, 1.002981399))
vector_2pt = Vector2Pt(PointA=square.Points, PointB=point, Unitize=False)  # -> Vector, Length
circle_cnr = CircleCNR(Center=square.Points, Normal=vector_2pt.Vector, Radius=Slider(0.5, range=0..1))
surface = Surface(circle_cnr)
