# Grasshopper definition 004K.Catenary.gh (Grasshopper 1.0.8)

unit_x = UnitX(Factor=1)
point = Point(Point(0, 0, 0))
line_sdl = LineSDL(Start=point, Direction=unit_x, Length=Slider(30, range=0..50))
divide_curve = DivideCurve(Curve=line_sdl, Count=10, Kinks=False)  # -> Points, Tangents, Parameters
polyline = PolyLine(Vertices=divide_curve.Points, Closed=False)
unit_z = UnitZ(Factor=Slider(2.44, range=0..10))
explode = Explode(Curve=polyline, Recursive=True)  # -> Segments, Vertices
negative = Negative(Value=unit_z)
list_item = ListItem(List=explode.Vertices, Index=0, Wrap=True)  # -> Item1, Item

# ---- group: Goals
load = Load(Point=explode.Vertices, ForceVector=negative, Weighting=1)
length_line = LengthLine(Line=explode.Segments, Strength=10)
anchor = Anchor(Point=[list_item.Item, list_item.Item1], Strength=10000)

# ----
bouncysolver = BouncySolver(
    GoalObjects=[length_line, anchor, load],
    Reset=Button(),
    Threshold=1e-15,
    Tolerance=0.0001,
    Damping=0.99,
    Iterations=10,
    On=True)  # -> I, V, O
