# Grasshopper definition 005K.CatenarySrf.gh (Grasshopper 1.0.8)

mesh_plane = MeshPlane(Boundary={Plane=PlaneXY(0, 0, 0), Size=Domain2(u=-10..10, v=-10..10)}, WidthCount=10, HeightCount=10)  # -> Mesh, Area
mesh_plane_2 = MeshPlane(Boundary={Plane=PlaneXY(0, 0, 0), Size=Domain2(u=-10..10, v=-10..10)}, WidthCount=10, HeightCount=10)  # -> Mesh, Area
deconstruct_mesh = DeconstructMesh(Mesh=mesh_plane.Mesh)  # -> Vertices, Faces, Colours, Normals
mesh_edges = MeshEdges(Mesh=mesh_plane.Mesh)  # -> NakedEdges, InteriorEdges, NonManifoldEdges
panel = Panel("""0
10
110
120""")
meshcorners = MeshCorners(Mesh=mesh_plane_2.Mesh, Angle=2.35619449)
list_item = ListItem(List=deconstruct_mesh.Vertices, Index=panel, Wrap=True)
edgelengths = EdgeLengths(Mesh=mesh_plane_2.Mesh, LengthFactor=1, Strength=10)
anchor = Anchor(Point=meshcorners, Strength=10000)
vertexloads = VertexLoads(Mesh=mesh_plane_2.Mesh, Strength=Slider(1, range=0..1))
load = Load(Point=deconstruct_mesh.Vertices, ForceVector=Vector(0, 0, 1), Weighting=1)
length_line = LengthLine(Line=[mesh_edges.InteriorEdges, mesh_edges.NakedEdges], Strength=10)
show = Show(G=mesh_plane_2.Mesh)
anchor_2 = Anchor(Point=list_item, Strength=10000)
show_2 = Show(G=mesh_plane.Mesh)
grab = Grab(On=True, Strength=1, Range=3)
bouncysolver = BouncySolver(
    GoalObjects=[anchor, show, vertexloads, edgelengths],
    Reset=Button(),
    Threshold=1e-15,
    Tolerance=0.0001,
    Damping=0.99,
    Iterations=10,
    On=True)  # -> I, V, O
bouncysolver_2 = BouncySolver(
    GoalObjects=[length_line, load, anchor_2, show_2, grab],
    Reset=Button(),
    Threshold=1e-15,
    Tolerance=0.0001,
    Damping=0.99,
    Iterations=10,
    On=True)  # -> I, V, O
