# Grasshopper definition 006K.FallBall.gh (Grasshopper 1.0.8)

rectangle = Rectangle({Plane=PlaneXY(1, 40, 0), Size=Domain2(u=-12..12, v=-18..18)})
populate_2d = Populate2D(Region=rectangle, Count=100, Seed=1)
curve = Curve(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)
offset_curve = OffsetCurve(Curve=curve, Distance=Slider(1, range=0..10), Corners=1)
unit_y = UnitY(Factor=".001")
curvepointcollide = CurvePointCollide(Points=populate_2d, Curve=offset_curve, Plane=PlaneXY(0, 0, 0), Interior=False, Strength=1)
spherecollide = SphereCollide(Points=populate_2d, Radius=1, Strength=1)
negative = Negative(Value=unit_y)
load = Load(Point=populate_2d, ForceVector=negative, Weighting=1)
bouncysolver = BouncySolver(
    GoalObjects=[load, curvepointcollide, spherecollide],
    Reset=Button(),
    Threshold=1e-15,
    Tolerance=0.0001,
    Damping=0.99,
    Iterations=10,
    On=True)  # -> I, V, O
circle = Circle(Plane=bouncysolver.V, Radius=1)
