# Grasshopper definition 007K.FallSrf.gh (Grasshopper 1.0.8)

number_slider = Slider(30, range=0..100)
mesh_plane = MeshPlane(
    Boundary={Plane=PlaneXY(0, 0, 0), Size=Domain2(u=-10..10, v=-10..10)},
    WidthCount=number_slider,
    HeightCount=number_slider)  # -> Mesh, Area
triangulate = Triangulate(Mesh=mesh_plane.Mesh)  # -> Mesh, Count
move = Move(Geometry=triangulate.Mesh, Motion=Vector(0, 0, 10))  # -> Geometry, Transform
deconstruct_mesh = DeconstructMesh(Mesh=move.Geometry)  # -> Vertices, Faces, Colours, Normals
unit_z = UnitZ(Factor=Slider(0.005, range=0..0.01))
negative = Negative(Value=unit_z)
brep = Brep(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)
load = Load(Point=deconstruct_mesh.Vertices, ForceVector=negative, Weighting=1)
edgelengths = EdgeLengths(Mesh=move.Geometry, LengthFactor=1, Strength=1)
solidpointcollide = SolidPointCollide(Points=deconstruct_mesh.Vertices, Solid=brep, Interior=False, Unidirectional=True, Strength=1)
grab = Grab(On=True, Strength=1, Range=3)
show = Show(G=move.Geometry)
spherecollide = SphereCollide(Points=deconstruct_mesh.Vertices, Radius=Slider(0.2, range=0..1), Strength=1)
bouncysolver = BouncySolver(
    GoalObjects=[load, solidpointcollide, edgelengths, show, spherecollide, grab],
    Reset=Button(),
    Threshold=1e-15,
    Tolerance=0.0001,
    Damping=0.99,
    Iterations=10,
    On=True)  # -> I, V, O
