# Grasshopper definition 008K.GrowingCrv.gh (Grasshopper 1.0.8)

curve = Curve(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)
divide_curve = DivideCurve(Curve=curve, Count=Slider(1000, range=0..1000), Kinks=False)  # -> Points, Tangents, Parameters
polyline = PolyLine(Vertices=divide_curve.Points, Closed=False)
explode = Explode(Curve=polyline, Recursive=True)  # -> Segments, Vertices
length_line = LengthLine(Line=explode.Segments, Strength=Slider(0.1, range=0..0.1))
spherecollide = SphereCollide(Points=explode.Vertices, Radius=Slider(0, range=0..1), Strength=1)
solver = Solver(GoalObjects=[spherecollide, length_line], Reset=Button(), Threshold=1e-15, Tolerance=0.0001, On=True)  # -> I, V, O
polyline_2 = PolyLine(Vertices=solver.V, Closed=False)
