# Grasshopper definition 009K.GrowingCrvOnMesh.gh (Grasshopper 1.0.8)

mesh = Mesh(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)
area = Area(Geometry=mesh)  # -> Area, Centroid
circle = Circle(Plane=area.Centroid, Radius=Slider(40, range=0..100))
divide_curve = DivideCurve(Curve=circle, Count=Slider(2000, range=0..2000), Kinks=False)  # -> Points, Tangents, Parameters
line = Line(StartPoint=area.Centroid, EndPoint=divide_curve.Points)
mesh_curve = MeshCurve(Mesh=mesh, Curve=line)  # -> flatten(Points), Faces
polyline = PolyLine(Vertices=mesh_curve.Points, Closed=False)
explode = Explode(Curve=polyline, Recursive=True)  # -> Segments, Vertices
length_line = LengthLine(Line=explode.Segments, Strength=Slider(0.1, range=0..0.1))
spherecollide = SphereCollide(Points=explode.Vertices, Radius=Slider(2.679931, range=0..10), Strength=1)
onmesh = OnMesh(Points=explode.Vertices, Mesh=mesh, Strength=1)
solver = Solver(GoalObjects=[length_line, spherecollide, onmesh], Reset=Button(), Threshold=1e-15, Tolerance=0.0001, On=True)  # -> I, V, O
polyline_2 = PolyLine(Vertices=solver.V, Closed=False)
