# Grasshopper definition 010K.WriterArm.gh (Grasshopper 1.0.8)

curve = Curve(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)
curve_2 = Curve(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)
explode = Explode(Curve=curve, Recursive=True)  # -> Segments, Vertices
evaluate_length = EvaluateLength(Curve=curve_2, Length=Slider(0.19652, range=0..1), Normalized=True)  # -> Point, Tangent, Parameter
list_item = ListItem(List=explode.Vertices, Index=0, Wrap=True)  # -> Item, Item1, Item2
length_line = LengthLine(Line=explode.Segments, Strength=10)
anchor = Anchor(Point=list_item.Item2, Target=evaluate_length.Point, Strength=10000)
onplane = OnPlane(Points=explode.Vertices, Plane=PlaneXY(0, 0, 0), Strength=1)
anchor_2 = Anchor(Point=list_item.Item, Strength=10000)
solver = Solver(GoalObjects=[length_line, anchor_2, onplane, anchor], Reset=False, Threshold=1e-15, Tolerance=0.0001, On=True)  # -> I, V, O
