# Grasshopper definition 011PicToGrid.gh (Grasshopper 1.0.8)

number_slider = Slider(50, range=0..100)
mesh_plane = MeshPlane(
    Boundary={Plane=PlaneXY(0, 0, 0), Size=Domain2(u=-10..10, v=-10..10)},
    WidthCount=number_slider,
    HeightCount=number_slider)  # -> Mesh, Area
bounding_box = BoundingBox(Content=mesh_plane.Mesh, Plane=PlaneXY(0, 0, 0))  # -> Box, Box_2
deconstruct_mesh = DeconstructMesh(Mesh=mesh_plane.Mesh)  # -> Vertices, Faces, Colours, Normals
surface = Surface(bounding_box.Box)
surface_closest_point = SurfaceClosestPoint(Point=deconstruct_mesh.Vertices, Surface=reparameterize(surface))  # -> Point, UVPoint, Distance
image_sampler = ImageSampler(surface_closest_point.UVPoint, Filter="Value", Interpolate=False, Umax=1, Umin=0, Vmax=1, Vmin=0, Wrap=1)
construct_domain = ConstructDomain(DomainStart=Slider(0.25, range=0..1), DomainEnd=Slider(0.02, range=0..1))
bounds = Bounds(Numbers=image_sampler)
remap_numbers = RemapNumbers(Value=image_sampler, Source=bounds, Target=construct_domain)  # -> Mapped, Clipped
circle = Circle(Plane=deconstruct_mesh.Vertices, Radius=remap_numbers.Mapped)
