# Grasshopper definition 012PicToH&C.gh (Grasshopper 1.0.8)

number_slider = Slider(150, range=0..150)
mesh_plane = MeshPlane(
    Boundary={Plane=PlaneXY(0, 0, 0), Size=Domain2(u=-10..10, v=-10..10)},
    WidthCount=number_slider,
    HeightCount=number_slider)  # -> Mesh, Area
deconstruct_mesh = DeconstructMesh(Mesh=mesh_plane.Mesh)  # -> Vertices, Faces, Colours, Normals
bounding_box = BoundingBox(Content=mesh_plane.Mesh, Plane=PlaneXY(0, 0, 0))  # -> Box, Box_2
surface_closest_point = SurfaceClosestPoint(Point=deconstruct_mesh.Vertices, Surface=reparameterize(bounding_box.Box))  # -> Point, UVPoint, Distance
image_sampler = ImageSampler(surface_closest_point.UVPoint, Filter="Value", Interpolate=False, Umax=1, Umin=0, Vmax=1, Vmin=0, Wrap=1)
image_sampler_2 = ImageSampler(surface_closest_point.UVPoint, Filter="Colour", Interpolate=False, Umax=1, Umin=0, Vmax=1, Vmin=0, Wrap=1)
multiplication = Multiplication(A=image_sampler, B=Slider(2.23, range=0..5))
unit_z = UnitZ(Factor=multiplication)
move = Move(Geometry=deconstruct_mesh.Vertices, Motion=unit_z)  # -> Geometry, Transform
construct_mesh = ConstructMesh(Vertices=move.Geometry, Faces=deconstruct_mesh.Faces, Colours=image_sampler_2)
