# Grasshopper definition 013Pattern3D.gh (Grasshopper 1.0.8)
# plug-ins: Weaverbird

brep = Brep(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)
simple_mesh = SimpleMesh(Brep=brep)
number_slider = Slider(8, range=0..10)
bounding_box = BoundingBox(Content=simple_mesh, Plane=PlaneXY(0, 0, 0))  # -> Box, Box_2
rectangular_array = RectangularArray(Geometry=simple_mesh, Cell=bounding_box.Box, XCount=number_slider, YCount=number_slider)  # -> Geometry, Transform
mesh_join = MeshJoin(Meshes=rectangular_array.Geometry)
weaverbird_s_mesh_thicken = WeaverbirdsMeshThicken(MeshCurves=mesh_join, Distance=Slider(1, range=0..10), OffsetType=0)
weaverbird_s_catmull_clark_subdivision = WeaverbirdsCatmullClarkSubdivision(MeshCurves=weaverbird_s_mesh_thicken, Level="3", SmoothNakedEdges=1)
custom_preview = CustomPreview(Geometry=weaverbird_s_catmull_clark_subdivision, Material=ColourSwatch(SwatchColor=RGB(72, 153, 131)))
