# Grasshopper definition 014RemeshByColor.gh (Grasshopper 1.0.8)
# plug-ins: Weaverbird

B = Boundary({Plane=PlaneXY(0, 0, 0), Size=Domain2(u=-16..16, v=-9..9)})
dimensions = Dimensions(Surface=B)  # -> UDimension, VDimension
mesh_plane = MeshPlane(Boundary=B, WidthCount=dimensions.UDimension, HeightCount=dimensions.VDimension)  # -> Mesh, Area
deconstruct_mesh = DeconstructMesh(Mesh=mesh_plane.Mesh)  # -> Vertices, Faces, Colours, Normals
point = Point([Point(4, 6, 0), Point(-6, 2, 0), Point(2, -8, 0)])
closest_point = ClosestPoint(Point=deconstruct_mesh.Vertices, Cloud=point)  # -> ClosestPoint, CPIndex, Distance
bounds = Bounds(Numbers=closest_point.Distance)
remap_numbers = RemapNumbers(Value=closest_point.Distance, Source=bounds, Target=Domain(0, 1))  # -> Mapped, Clipped
graph_mapper = GraphMapper(
    remap_numbers.Mapped,
    x0=0,
    x1=1,
    y0=0,
    y1=1,
    container_name="Bezier",
    cpx=[0, 0, 0.4763050973, 1],
    cpy=[0, 0.6244020462, 1, 1])
gradient = Gradient(LowerLimit=0, UpperLimit=1, Parameter=graph_mapper, stops=[0: RGB(255, 255, 255), 1: RGB(0, 0, 0)])
explode = Explode(Curve=B, Recursive=True)  # -> Segments, Vertices
construct_mesh = ConstructMesh(Vertices=deconstruct_mesh.Vertices, Faces=deconstruct_mesh.Faces, Colours=gradient)
removeduplicatepts = RemoveDuplicatePts(Points=explode.Vertices, Tolerance=0.01)
construct_domain = ConstructDomain(DomainStart=Slider(0.2, range=0..1), DomainEnd=Slider(2, range=0..10))
remeshbycolour = RemeshByColour(
    Mesh=construct_mesh,
    LengthInterval=construct_domain,
    FixCurves=explode.Segments,
    FixVertices=removeduplicatepts,
    Flip=1,
    Iterations=Slider(10, range=0..100),
    Reset=Toggle(False))
weaverbird_s_picture_frame = WeaverbirdsPictureFrame(MeshPolylines=remeshbycolour, Distance=Slider(0.01, range=0..1), InsetType=1)
face_boundaries = FaceBoundaries(Mesh=remeshbycolour)
weaverbird_s_catmull_clark_subdivision = WeaverbirdsCatmullClarkSubdivision(MeshCurves=weaverbird_s_picture_frame, Level=Slider(2, range=0..3), SmoothNakedEdges=1)
