# Grasshopper definition 015PPattern2D.gh (Grasshopper 1.0.8)

number_slider = Slider(27, range=0..100)
square = Square(Plane=PlaneXY(0, 0, 0), Size=Slider(10, range=0..10), ExtentX=number_slider, ExtentY=number_slider)  # -> Cells, Points
point = Point(flatten(square.Points))
jitter = Jitter(List=point, Jitter=Slider(1, range=0..1), Seed=2)  # -> Values, Indices
list_length = ListLength(List=jitter.Values)
multiplication = Multiplication(A=list_length, B=Slider(0.498, range=0..1))
curve = Curve(graft([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]))
curve_2 = Curve(graft([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]))
split_list = SplitList(List=jitter.Values, Index=multiplication)  # -> ListA, ListB
orient = Orient(Geometry=curve, Source=PlaneXY(0, 0, 0), Target=split_list.ListA)  # -> Geometry, Transform
orient_2 = Orient(Geometry=curve_2, Source=PlaneXY(0, 0, 0), Target=split_list.ListB)  # -> Geometry, Transform
