# Grasshopper definition 016WembleyCatenary.gh (Grasshopper 1.0.8)

vector_xyz = VectorXYZ(XComponent=Slider(0.343, range=0..1), YComponent=Slider(0, range=0..1), ZComponent=Slider(0.474, range=0..1))  # -> Vector, Length
point = Point(Point(0, 0, 0))
point_2 = Point(Point(0, 30, 0))
catenary = Catenary(PointA=point_2, PointB=point, Length=Slider(41.466, range=0..100), Gravity=vector_xyz.Vector)
number_slider = Slider(10, range=0..100)
pi = Pi(Factor=Slider(2, range=0..10))
perp_frames = PerpFrames(Curve=catenary, Count=number_slider, Align=True)  # -> Frames, Parameters
range = Range(Domain=pi, Steps=number_slider)
circle = Circle(Plane=perp_frames.Frames, Radius=Slider(1.74, range=0..10))
rotate = Rotate(Geometry=circle, Angle=range, Plane=perp_frames.Frames)  # -> Geometry, Transform
divide_curve = DivideCurve(Curve=rotate.Geometry, Count=10, Kinks=False)  # -> Points, Tangents, Parameters
shift_list = ShiftList(List=divide_curve.Points, Shift=1, Wrap=True)
flip_matrix = FlipMatrix(Data=shift_list)
polyline = PolyLine(Vertices=flip_matrix, Closed=False)
