# Grasshopper definition 017Fiber.gh (Grasshopper 1.0.8)
# plug-ins: LunchBox

xy_plane = XYPlane(Origin=Point(0, 0, 0))
rectangle = Rectangle(Plane=xy_plane, XSize=Slider(20, range=0..100), YSize=Slider(50, range=0..100), Radius=0)  # -> Rectangle, Length
quad_panels = QuadPanels(Surface=rectangle.Rectangle, UDivisions=Slider(99, range=0..100), VDivisions=Slider(94, range=0..100))
area = Area(Geometry=quad_panels)  # -> Area, Centroid
curve = Curve(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)
curve_closest_point = CurveClosestPoint(Point=area.Centroid, Curve=curve)  # -> Point, Parameter, Distance
construct_domain = ConstructDomain(DomainStart=Slider(1, range=0..100), DomainEnd=Slider(20, range=0..100))
construct_domain_2 = ConstructDomain(DomainStart=Slider(0, range=0..100), DomainEnd=Slider(75.18, range=0..100))
bounds = Bounds(Numbers=curve_closest_point.Distance)
unit_y = UnitY(Factor=1)
unit_x = UnitX(Factor=1)
unit_z = UnitZ(Factor=1)
remap_numbers = RemapNumbers(Value=curve_closest_point.Distance, Source=bounds, Target=construct_domain)  # -> Mapped, Clipped
remap_numbers_2 = RemapNumbers(Value=curve_closest_point.Distance, Source=bounds, Target=construct_domain_2)  # -> Mapped, Clipped
number_slider = Slider(11, range=0..100)
line_sdl = LineSDL(Start=area.Centroid, Direction=unit_z, Length=reverse(remap_numbers.Mapped))
line_sdl_2 = LineSDL(Start=area.Centroid, Direction=unit_y, Length=number_slider)
line_sdl_3 = LineSDL(Start=area.Centroid, Direction=unit_x, Length=number_slider)
rotate_3d = Rotate3D(Geometry=line_sdl, Angle=degrees(remap_numbers_2.Mapped), Center=area.Centroid, Axis=line_sdl_3)  # -> Geometry, Transform
rotate_3d_2 = Rotate3D(Geometry=rotate_3d.Geometry, Angle=degrees(remap_numbers_2.Mapped), Center=area.Centroid, Axis=line_sdl_2)  # -> Geometry, Transform
pipe = Pipe(Curve=rotate_3d_2.Geometry, Radius=Slider(0.05, range=0..1), Caps="1")
custom_preview = CustomPreview(Geometry=pipe, Material=ColourSwatch(SwatchColor=RGB(112, 117, 40)))
