# Grasshopper definition 018Lungs.gh (Grasshopper 1.0.8)

number_slider = Slider(6.09, range=0..10)
construct_point = ConstructPoint(XCoordinate=0, YCoordinate=Slider(5.64, range=0..100), ZCoordinate=Slider(5.5, range=0..10))
construct_point_2 = ConstructPoint(XCoordinate=0, YCoordinate=0, ZCoordinate=number_slider)
number_slider_2 = Slider(43.37, range=0..100)
unit_x = UnitX(Factor=1)
line_sdl = LineSDL(Start=construct_point, Direction=unit_x, Length=number_slider_2)
line_sdl_2 = LineSDL(Start=construct_point_2, Direction=unit_x, Length=number_slider_2)
number_slider_3 = Slider(70, range=0..100)
divide_curve = DivideCurve(Curve=line_sdl, Count=number_slider_3, Kinks=False)  # -> Points, Tangents, Parameters
divide_curve_2 = DivideCurve(Curve=line_sdl_2, Count=number_slider_3, Kinks=False)  # -> Points, Tangents, Parameters
range = Range(Domain=Domain(0, 1), Steps=number_slider_3)
graph_mapper = GraphMapper(range, x0=0, x1=1, y0=0, y1=1, Ox=0.5012491345, Oy=1, Px=0.9224696755, Py=0.2840310931, container_name="Parabola")
project = Project(Geometry=divide_curve_2.Points, Plane=PlaneXY(0, 0, 0))  # -> Geometry, Transform
multiplication = Multiplication(A=Slider(8.92, range=0..10), B=graph_mapper)
multiplication_2 = Multiplication(A=graph_mapper, B=Slider(5.37, range=0..10))
unit_y = UnitY(Factor=multiplication)
unit_z = UnitZ(Factor=multiplication_2)
move = Move(Geometry=divide_curve.Points, Motion=unit_y)  # -> Geometry, Transform
move_2 = Move(Geometry=divide_curve.Points, Motion=unit_z)  # -> Geometry, Transform
cull_index = CullIndex(List=move.Geometry, Indices=["0", "-1"], Wrap=True)
cull_index_2 = CullIndex(List=move_2.Geometry, Indices=["0", "-1"], Wrap=True)
line = Line(StartPoint=cull_index, EndPoint=cull_index_2)
interpolate = Interpolate(Vertices=cull_index, Degree=3, Periodic=False, KnotStyle=1)  # -> Curve, Length, Domain
interpolate_2 = Interpolate(Vertices=cull_index_2, Degree=3, Periodic=False, KnotStyle=1)  # -> Curve, Length, Domain
merge = Merge(Data1=interpolate.Curve, Data2=interpolate_2.Curve)
number_slider_4 = Slider(0.2, range=0..1)
unit_z_2 = UnitZ(Factor=1)
point = Point(project.Geometry)
curve_middle = CurveMiddle(Curve=line)
extrude = Extrude(Base=line, Direction=unit_z_2)
negative = Negative(Value=number_slider_4)
offset_curve = OffsetCurve(Curve=line, Distance=negative, Plane=extrude, Corners=1)
offset_curve_2 = OffsetCurve(Curve=line, Distance=number_slider_4, Plane=extrude, Corners=1)
area = Area(Geometry=extrude)  # -> Area, Centroid
construct_domain = ConstructDomain(DomainStart=Slider(90, range=0..100), DomainEnd=Slider(270, range=0..1000))
curve_middle_2 = CurveMiddle(Curve=offset_curve)
curve_middle_3 = CurveMiddle(Curve=offset_curve_2)
distance = Distance(PointA=area.Centroid, PointB="0,0,0")
end_points = EndPoints(Curve=line)  # -> Start, End
bounds = Bounds(Numbers=distance)
merge_2 = Merge(
    Data1=simplify(graft(end_points.Start)),
    Data2=simplify(graft(curve_middle_2)),
    Data3=simplify(graft(end_points.End)),
    Data4=simplify(graft(curve_middle_3)))
remap_numbers = RemapNumbers(Value=distance, Source=bounds, Target=construct_domain)  # -> Mapped, Clipped
interpolate_3 = Interpolate(Vertices=merge_2, Degree=3, Periodic=Toggle(True), KnotStyle=1)  # -> Curve, Length, Domain
curve = Curve(line)
surface = Surface(interpolate_3.Curve)
interpolate_4 = Interpolate(Vertices=area.Centroid, Degree=3, Periodic=False, KnotStyle=1)  # -> Curve, Length, Domain
line_2 = Line(StartPoint=curve_middle, EndPoint=point)
rotate_axis = RotateAxis(Geometry=simplify(graft(surface)), Angle=simplify(graft(degrees(remap_numbers.Mapped))), Axis=simplify(graft(curve)))  # -> Geometry, Transform
xz_plane = XZPlane(Origin=Point(0, 0, 0))
curve_2 = Curve(merge)
negative_2 = Negative(Value=number_slider)
mirror = Mirror(Geometry=rotate_axis.Geometry, Plane=xz_plane)  # -> Geometry, Transform
mirror_2 = Mirror(Geometry=interpolate_4.Curve, Plane=xz_plane)  # -> Geometry, Transform
mirror_3 = Mirror(Geometry=curve_2, Plane=xz_plane)  # -> Geometry, Transform
mirror_4 = Mirror(Geometry=line_2, Plane=xz_plane)  # -> Geometry, Transform
line_3 = Line(StartPoint=project.Geometry, EndPoint=divide_curve_2.Points)
unit_z_3 = UnitZ(Factor=negative_2)
merge_3 = Merge(Data1=rotate_axis.Geometry, Data2=mirror.Geometry)
merge_4 = Merge(Data1=interpolate_4.Curve, Data2=mirror_2.Geometry)
merge_5 = Merge(Data1=curve_2, Data2=mirror_3.Geometry)
merge_6 = Merge(Data1=line_2, Data2=mirror_4.Geometry)
move_3 = Move(Geometry=line_3, Motion=unit_z_3)  # -> Geometry, Transform
surface_2 = Surface(merge_3)
pipe = Pipe(Curve=merge_3, Radius=Slider(0.05, range=0..1), Caps=0)
merge_7 = Merge(Data1=merge_4, Data2=merge_5, Data3=merge_6, Data4=move_3.Geometry)
pipe_2 = Pipe(Curve=merge_7, Radius=Slider(0.1, range=0..1), Caps=0)
