# Grasshopper definition 019PVLN.gh (Grasshopper 1.0.8)

number_slider = Slider(1.36, range=0..100)
number_slider_2 = Slider(20, range=0..100)
negative = Negative(Value=number_slider)
negative_2 = Negative(Value=number_slider_2)
construct_domain = ConstructDomain(DomainStart=negative, DomainEnd=number_slider)
construct_domain_2 = ConstructDomain(DomainStart=negative_2, DomainEnd=number_slider_2)
xy_plane = XYPlane(Origin=Point(0, 0, 0))
number_slider_3 = Slider(30, range=0..100)
rectangle = Rectangle(Plane=xy_plane, XSize=construct_domain, YSize=construct_domain_2, Radius=0)  # -> Rectangle, Length
expression = Expression(x=number_slider_3, Expression="360/x")
area = Area(Geometry=rectangle.Rectangle)  # -> Area, Centroid
series = Series(Start=0, Step=number_slider_3, Count=expression)
rotate = Rotate(Geometry=rectangle.Rectangle, Angle=degrees(series), Plane=area.Centroid)  # -> Geometry, Transform
region_union = RegionUnion(Curves=flatten(rotate.Geometry))
number_slider_4 = Slider(0.46, range=0..1)
solid_union = SolidUnion(Breps=simplify(flatten(region_union)))
series_2 = Series(Start=number_slider_4, Step=number_slider_4, Count=Slider(50, range=0..100))
curve = Curve(solid_union)
fillet = Fillet(Curve=curve, Radius=Slider(12, range=0..100))
circle = Circle(Plane=PlaneXY(0, 0, 0), Radius=series_2)
curve_curve = CurveCurve(CurveA=graft(fillet), CurveB=flatten(circle))  # -> Points, ParamsA, ParamsB
clean_tree = CleanTree(RemoveNulls=True, RemoveInvalid=invert(True), RemoveEmpty=invert(False), Tree=curve_curve.Points)
polyline = PolyLine(Vertices=clean_tree, Closed=Toggle(True))
deconstruct_brep = DeconstructBrep(Brep=polyline)  # -> Faces, Edges, Vertices
curve_middle = CurveMiddle(Curve=deconstruct_brep.Edges)
point_in_curves = PointInCurves(Point=curve_middle, Curves=fillet)  # -> Relationship, Index, Point
dispatch = Dispatch(List=deconstruct_brep.Edges, DispatchPattern=point_in_curves.Relationship)  # -> ListA, ListB
curve_2 = Curve(dispatch.ListB)
curve_3 = Curve(dispatch.ListA)
number_slider_5 = Slider(7.19, range=0..100)
unit_z = UnitZ(Factor=number_slider_5)
unit_z_2 = UnitZ(Factor=Slider(7.19, range=0..100))
move = Move(Geometry=curve_3, Motion=unit_z)  # -> Geometry, Transform
move_2 = Move(Geometry=curve_2, Motion=unit_z_2)  # -> Geometry, Transform
clean_tree_2 = CleanTree(RemoveNulls=True, RemoveInvalid=invert(True), RemoveEmpty=invert(False), Tree=move.Geometry)
clean_tree_3 = CleanTree(RemoveNulls=True, RemoveInvalid=invert(True), RemoveEmpty=invert(False), Tree=move_2.Geometry)
end_points = EndPoints(Curve=clean_tree_2)  # -> Start, End
curve_middle_2 = CurveMiddle(Curve=clean_tree_2)
end_points_2 = EndPoints(Curve=clean_tree_3)  # -> Start, End
curve_middle_3 = CurveMiddle(Curve=clean_tree_3)
unit_z_3 = UnitZ(Factor=Slider(7.15, range=0..10))
unit_z_4 = UnitZ(Factor=Slider(3.25, range=0..10))
negative_3 = Negative(Value=unit_z_3)
negative_4 = Negative(Value=unit_z_4)
move_3 = Move(Geometry=curve_middle_2, Motion=negative_3)  # -> Geometry, Transform
move_4 = Move(Geometry=curve_middle_3, Motion=negative_4)  # -> Geometry, Transform
merge = Merge(Data1=simplify(graft(end_points.Start)), Data2=simplify(graft(move_3.Geometry)), Data3=simplify(graft(end_points.End)))
merge_2 = Merge(
    Data1=simplify(graft(end_points_2.Start)),
    Data2=simplify(graft(move_4.Geometry)),
    Data3=simplify(graft(end_points_2.End)))
interpolate = Interpolate(Vertices=merge, Degree=3, Periodic=False, KnotStyle=1)  # -> Curve, Length, Domain
interpolate_2 = Interpolate(Vertices=merge_2, Degree=3, Periodic=False, KnotStyle=1)  # -> Curve, Length, Domain
clean_tree_4 = CleanTree(RemoveNulls=True, RemoveInvalid=True, RemoveEmpty=False, Tree=interpolate.Curve)
merge_3 = Merge(Data1=clean_tree_4)
join_curves = JoinCurves(Curves=flatten(merge_3), Preserve=False)
explode = Explode(Curve=join_curves, Recursive=True)  # -> Segments, Vertices
unit_z_5 = UnitZ(Factor=1)
amplitude = Amplitude(Vector=unit_z_5, Amplitude=Slider(7, range=0..100))
negative_5 = Negative(Value=number_slider_5)
move_5 = Move(Geometry=explode.Vertices, Motion=amplitude)  # -> Geometry, Transform
unit_z_6 = UnitZ(Factor=negative_5)
move_6 = Move(Geometry=move_5.Geometry, Motion=unit_z_6)  # -> Geometry, Transform
curve_4 = Curve(interpolate_2.Curve)
curve_5 = Curve(clean_tree_4)
line = Line(StartPoint=move_5.Geometry, EndPoint=move_6.Geometry)
merge_4 = Merge(Data1=line, Data2=curve_5)
clean_tree_5 = CleanTree(RemoveNulls=True, RemoveInvalid=True, RemoveEmpty=False, Tree=curve_4)
join_curves_2 = JoinCurves(Curves=flatten(merge_4), Preserve=False)
join_curves_3 = JoinCurves(Curves=flatten([curve_4, curve_5]), Preserve=False)
number_slider_6 = Slider(0.1, range=0..0.1)
list_item = ListItem(List=join_curves_3, Index=0, Wrap=True)
patch = Patch(Curves=list_item, Spans=20, Flexibility=1, Trim=True)
negative_6 = Negative(Value=number_slider_6)
area_2 = Area(Geometry=patch)  # -> Area, Centroid
offset_curve = OffsetCurve(Curve=join_curves_2, Distance=number_slider_6, Corners=1)
offset_curve_2 = OffsetCurve(Curve=clean_tree_5, Distance=negative_6, Corners=1)
extrude_point = ExtrudePoint(Base=list_item, Point=area_2.Centroid)
merge_5 = Merge(Data1=simplify(graft(join_curves_2)), Data2=simplify(graft(offset_curve)))
merge_6 = Merge(Data1=simplify(graft(clean_tree_5)), Data2=simplify(graft(offset_curve_2)))
loft = Loft(Curves=merge_5, Options={Adjust=False, Closed=False, LoftEnds=0, LoftSimp=0, LoftType=0, Rebuild=10, Refit=0.01})
loft_2 = Loft(Curves=merge_6, Options={Adjust=False, Closed=False, LoftEnds=0, LoftSimp=0, LoftType=0, Rebuild=10, Refit=0.01})
merge_7 = Merge(Data1=loft, Data2=loft_2)
area_3 = Area(Geometry=merge_7)  # -> Area, Centroid
evaluate_surface = EvaluateSurface(Surface=merge_7, Point=area_3.Centroid)  # -> Point, Normal, UDirection, VDirection, Frame
multiplication = Multiplication(A=Slider(0.08, range=0..0.1), B=evaluate_surface.Normal)
negative_7 = Negative(Value=multiplication)
extrude = Extrude(Base=merge_7, Direction=negative_7)
extrude_2 = Extrude(Base=merge_7, Direction=multiplication)
colour_picker = ColourPicker(PickedColour=RGB(14, 88, 130))
colour_picker_2 = ColourPicker(PickedColour=RGB(173, 118, 35))
merge_8 = Merge(Data1=extrude_2, Data2=extrude)
xy_plane_2 = XYPlane(Origin=Point(0, 0, 0))
xy_plane_3 = XYPlane(Origin=Point(0, 0, 0))
mirror = Mirror(Geometry=merge_8, Plane=xy_plane_2)  # -> Geometry, Transform
mirror_2 = Mirror(Geometry=extrude_point, Plane=xy_plane_3)  # -> Geometry, Transform
create_material = CreateMaterial(
    Diffuse=colour_picker,
    Specular=RGB(255, 255, 255),
    Emission=RGB(0, 0, 0),
    Transparency=0,
    Shine=Slider(10, range=0..100))
create_material_2 = CreateMaterial(
    Diffuse=colour_picker_2,
    Specular=RGB(255, 255, 255),
    Emission=RGB(0, 0, 0),
    Transparency=0,
    Shine=Slider(40, range=0..100))
custom_preview = CustomPreview(Geometry=mirror.Geometry, Material=create_material)
custom_preview_2 = CustomPreview(Geometry=mirror_2.Geometry, Material=create_material_2)
