# Grasshopper definition 20Snake.gh (Grasshopper 1.0.8)
# plug-ins: Weaverbird

number_slider = Slider(1000, range=0..1000)
curve = Curve(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)
perp_frames = PerpFrames(Curve=curve, Count=expr("x-1", number_slider), Align=True)  # -> Frames, Parameters
series = Series(Start=0, Step="137.508", Count=number_slider)
rotate_plane = RotatePlane(Plane=perp_frames.Frames, Angle=degrees(Slider(116.7, range=0..360)))
number_slider_2 = Slider(5, range=0..10)
number_slider_3 = Slider(13, range=0..100)
point_cylindrical = PointCylindrical(BasePlane=rotate_plane, Angle=degrees(series), Radius=Slider(13.29, range=0..100), Elevation=0)
boolean_toggle = BooleanToggle(False)
series_2 = Series(Start=0, Step=1, Count=number_slider)
addition = Addition(A=number_slider_2, B=number_slider_3)
shift_list = ShiftList(List=series_2, Shift=number_slider_2, Wrap=boolean_toggle)
shift_list_2 = ShiftList(List=series_2, Shift=number_slider_3, Wrap=boolean_toggle)
shift_list_3 = ShiftList(List=series_2, Shift=addition, Wrap=boolean_toggle)
graft_tree = GraftTree(Tree=series_2, IncludeEmptyLists=True, IncludeNullItems=True)  # -> simplify(Tree)
graft_tree_2 = GraftTree(Tree=shift_list, IncludeEmptyLists=True, IncludeNullItems=True)  # -> simplify(Tree)
graft_tree_3 = GraftTree(Tree=shift_list_2, IncludeEmptyLists=True, IncludeNullItems=True)  # -> simplify(Tree)
graft_tree_4 = GraftTree(Tree=shift_list_3, IncludeEmptyLists=True, IncludeNullItems=True)  # -> simplify(Tree)
merge = Merge(Data1=graft_tree, Data2=graft_tree_2, Data3=graft_tree_4, Data4=graft_tree_3)
list_length = ListLength(List=merge)
equality = Equality(FirstNumber=list_length, SecondNumber="4")  # -> Equality, Inequality
cull_pattern = CullPattern(List=merge, CullPattern=equality.Equality)
clean_tree = CleanTree(RemoveNulls=True, RemoveInvalid=True, RemoveEmpty=Toggle(True), Tree=cull_pattern)
list_item = ListItem(List=clean_tree, Index=0, Wrap=True)  # -> Item, Item1, Item2, Item3
point = Point(point_cylindrical)
mesh_quad = MeshQuad(CornerA=list_item.Item, CornerB=list_item.Item1, CornerC=list_item.Item2, CornerD=list_item.Item3)  # -> flatten(Face)
construct_mesh = ConstructMesh(Vertices=point, Faces=mesh_quad)
face_boundaries = FaceBoundaries(Mesh=construct_mesh)
discontinuity = Discontinuity(Curve=face_boundaries, Level=1)  # -> Points, Parameters
curve_2 = Curve(curve)
list_item_2 = ListItem(List=discontinuity.Points, Index=0, Wrap=True)  # -> Item, Item1, Item2, Item3
curve_closest_point = CurveClosestPoint(Point=list_item_2.Item3, Curve=curve_2)  # -> Point, Parameter, Distance
vector_2pt = Vector2Pt(PointA=curve_closest_point.Point, PointB=list_item_2.Item3, Unitize=False)  # -> Vector, Length
amplitude = Amplitude(Vector=vector_2pt.Vector, Amplitude=Slider(2.461, range=0..10))
move = Move(Geometry=list_item_2.Item3, Motion=amplitude)  # -> Geometry, Transform
merge_2 = Merge(Data1=list_item_2.Item, Data2=list_item_2.Item1, Data3=list_item_2.Item2, Data4=move.Geometry)
average = Average(Input=merge_2)
scale = Scale(Geometry=merge_2, Center=average, Factor=Slider(1.25, range=0..10))  # -> Geometry, Transform
construct_mesh_2 = ConstructMesh(Vertices=scale.Geometry, Faces={A=0, B=1, C=2, D=3})
weaverbird_s_catmull_clark_subdivision = WeaverbirdsCatmullClarkSubdivision(MeshCurves=construct_mesh_2, Level=Slider(1, range=0..3), SmoothNakedEdges=0)
weaverbird_s_mesh_thicken = WeaverbirdsMeshThicken(MeshCurves=weaverbird_s_catmull_clark_subdivision, Distance=Slider(1.5, range=0..2), OffsetType=0)
weaverbird_s_catmull_clark_subdivision_2 = WeaverbirdsCatmullClarkSubdivision(MeshCurves=weaverbird_s_mesh_thicken, Level=Slider(3, range=0..3), SmoothNakedEdges=1)
colour_picker = ColourPicker(PickedColour=RGB(110, 18, 18))
create_material = CreateMaterial(
    Diffuse=colour_picker,
    Specular=RGB(255, 255, 255),
    Emission=RGB(0, 0, 0),
    Transparency=0,
    Shine=Slider(55, range=0..100))
custom_preview = CustomPreview(Geometry=weaverbird_s_catmull_clark_subdivision_2, Material=create_material)
