# Grasshopper definition 21.545.gh (Grasshopper 1.0.8)
# plug-ins: LunchBox

number_slider = Slider(4.74, range=0..100)
construct_point = ConstructPoint(XCoordinate=0, YCoordinate=number_slider, ZCoordinate=Slider(24, range=0..100))
construct_point_2 = ConstructPoint(XCoordinate=0, YCoordinate=number_slider, ZCoordinate=Slider(12, range=0..100))
unit_x = UnitX(Factor=1)
number_slider_2 = Slider(70, range=0..100)
line_sdl = LineSDL(Start=construct_point, Direction=unit_x, Length=number_slider_2)
line_sdl_2 = LineSDL(Start=construct_point_2, Direction=unit_x, Length=number_slider_2)
number_slider_3 = Slider(41, range=0..100)
divide_curve = DivideCurve(Curve=line_sdl, Count=number_slider_3, Kinks=False)  # -> Points, Tangents, Parameters
range = Range(Domain=Domain(0, 1), Steps=number_slider_3)
range_2 = Range(Domain=Domain(0, 1), Steps=number_slider_3)
graph_mapper = GraphMapper(range, x0=0, x1=1, y0=0, y1=1, container_name="Sine", Equation_px=[0, 0.501499176], Equation_py=[0, 1])
graph_mapper_2 = GraphMapper(range_2, x0=0, x1=1, y0=0, y1=1, container_name="Sine", Equation_px=[0, 0.501499176], Equation_py=[0, 1])
number_slider_4 = Slider(5.4, range=0..10)
addition = Addition(A=number_slider_4, B=Slider(4.47, range=0..10))
multiplication = Multiplication(A=graph_mapper, B=Slider(5.4, range=0..10))
multiplication_2 = Multiplication(A=graph_mapper_2, B=number_slider_4)
negative = Negative(Value=addition)
unit_z = UnitZ(Factor=multiplication)
unit_y = UnitY(Factor=multiplication_2)
move = Move(Geometry=divide_curve.Points, Motion=unit_y)  # -> Geometry, Transform
offset_curve = OffsetCurve(Curve=line_sdl_2, Distance=negative, Corners=1)
project = Project(Geometry=offset_curve, Plane=PlaneXY(0, 0, 0))  # -> Geometry, Transform
list_length = ListLength(List=flatten(move.Geometry))
expression = Expression(x=list_length, Expression="x-1")
divide_curve_2 = DivideCurve(Curve=offset_curve, Count=expression, Kinks=False)  # -> Points, Tangents, Parameters
divide_curve_3 = DivideCurve(Curve=project.Geometry, Count=expression, Kinks=False)  # -> Points, Tangents, Parameters
move_2 = Move(Geometry=divide_curve_2.Points, Motion=unit_z)  # -> Geometry, Transform
merge = Merge(
    Data1=simplify(graft(move.Geometry)),
    Data2=simplify(graft(move_2.Geometry)),
    Data3=simplify(graft(divide_curve_3.Points)))
xz_plane = XZPlane(Origin=Point(0, 0, 0))
point = Point(move.Geometry)
polyline = PolyLine(Vertices=merge, Closed=False)
mirror = Mirror(Geometry=move.Geometry, Plane=xz_plane)  # -> Geometry, Transform
mirror_2 = Mirror(Geometry=polyline, Plane=xz_plane)  # -> Geometry, Transform
unit_z_2 = UnitZ(Factor=1)
negative_2 = Negative(Value=unit_z_2)
arc_sed = ArcSED(Start=point, End=mirror.Geometry, Direction=negative_2)  # -> Arc, Plane, Radius
merge_2 = Merge(Data1=simplify(graft(arc_sed.Arc)), Data2=simplify(graft(polyline)), Data3=simplify(graft(mirror_2.Geometry)))
join_curves = JoinCurves(Curves=flatten(merge_2), Preserve=False)  # -> simplify(Curves)
negative_3 = Negative(Value=Slider(0.3, range=0..1))
offset_curve_2 = OffsetCurve(Curve=join_curves, Distance=negative_3, Corners=1)
explode = Explode(Curve=join_curves, Recursive=True)  # -> Segments, Vertices
merge_3 = Merge(Data1=simplify(graft(join_curves)), Data2=simplify(graft(offset_curve_2)))
list_item = ListItem(List=explode.Segments, Index=0, Wrap=True)  # -> Item, Item1, Item2, Item3, Item4
curve = Curve(list_item.Item)
curve_2 = Curve(list_item.Item4)
loft = Loft(Curves=flatten(curve), Options={Adjust=False, Closed=False, LoftEnds=0, LoftSimp=0, LoftType=0, Rebuild=10, Refit=0.01})
loft_2 = Loft(
    Curves=flatten(curve_2),
    Options={Adjust=False, Closed=False, LoftEnds=0, LoftSimp=0, LoftType=0, Rebuild=10, Refit=0.01})
loft_3 = Loft(Curves=arc_sed.Arc, Options={Adjust=False, Closed=False, LoftEnds=0, LoftSimp=0, LoftType=0, Rebuild=10, Refit=0.01})
loft_4 = Loft(Curves=merge_3, Options={Adjust=False, Closed=False, LoftEnds=0, LoftSimp=0, LoftType=0, Rebuild=10, Refit=0.01})
unit_x_2 = UnitX(Factor=Slider(0.35, range=0..1))
merge_4 = Merge(Data1=loft, Data2=loft_2)
extrude = Extrude(Base=loft_4, Direction=unit_x_2)
list_length_2 = ListLength(List=flatten(extrude))
expression_2 = Expression(x=list_length_2, Expression="x+1")
number_slider_5 = Slider(1, range=0..1)
space_truss_structure_1 = SpaceTrussStructure1(Surface=loft_3, UDivisions=expression_2, VDivisions=Slider(20, range=0..100), TrussDepth=number_slider_5)  # -> PrimaryLines, PrimaryLines_2, WebLines, StructureNodes
space_truss_structure_1_2 = SpaceTrussStructure1(Surface=merge_4, UDivisions=expression_2, VDivisions=Slider(10, range=0..100), TrussDepth=number_slider_5)  # -> PrimaryLines, PrimaryLines_2, WebLines, StructureNodes
colour_picker = ColourPicker(PickedColour=RGB(33, 84, 112))
curve_3 = Curve([space_truss_structure_1.WebLines, space_truss_structure_1.PrimaryLines_2, space_truss_structure_1.PrimaryLines])
curve_4 = Curve([space_truss_structure_1_2.PrimaryLines, space_truss_structure_1_2.PrimaryLines_2, space_truss_structure_1_2.WebLines])
colour_picker_2 = ColourPicker(PickedColour=RGB(74, 100, 145))
multipipe = MultiPipe(
    Curves=curve_3,
    NodeSize=Slider(0.02, range=0..0.1),
    EndOffset=1,
    StrutSize=1,
    Segment=0,
    KinkAngle=0.6,
    CubeFit=0,
    Caps="1")
multipipe_2 = MultiPipe(
    Curves=curve_4,
    NodeSize=Slider(0.05, range=0..0.1),
    EndOffset=1,
    StrutSize=1,
    Segment=0,
    KinkAngle=0.6,
    CubeFit=0,
    Caps="1")
create_material = CreateMaterial(
    Diffuse=colour_picker,
    Specular=RGB(255, 255, 255),
    Emission=RGB(0, 0, 0),
    Transparency=0,
    Shine=Slider(100, range=0..100))
brep = Brep(extrude)
create_material_2 = CreateMaterial(
    Diffuse=colour_picker_2,
    Specular=RGB(255, 255, 255),
    Emission=RGB(0, 0, 0),
    Transparency=0,
    Shine=Slider(20, range=0..100))
custom_preview = CustomPreview(Geometry=[multipipe_2, multipipe], Material=create_material)
custom_preview_2 = CustomPreview(Geometry=brep, Material=create_material_2)
