# Grasshopper definition 22wavyRing.gh (Grasshopper 1.0.8)

سایز_رینگ_ریل = Slider(56, range=40..70)
expression = Expression(x=سایز_رینگ_ریل, Expression="x/(2*π)")
xz_plane = XZPlane(Origin=Point(0, 0, 0))
circle = Circle(Plane=xz_plane, Radius=expression)
میزان_موج = Slider(21, range=3..100)
expression_2 = Expression(x=میزان_موج, Expression="x*3")
divide_curve = DivideCurve(Curve=circle, Count=expression_2, Kinks=False)  # -> Points, Tangents, Parameters
عرض_روی_انگشت = Slider(3, range=0..10)
division = Division(A=عرض_روی_انگشت, B="2")
unit_y = UnitY(Factor=division)
negative = Negative(Value=unit_y)
move = Move(Geometry=circle, Motion=unit_y)  # -> Geometry, Transform
move_2 = Move(Geometry=circle, Motion=negative)  # -> Geometry, Transform
move_3 = Move(Geometry=divide_curve.Points, Motion=unit_y)  # -> Geometry, Transform
move_4 = Move(Geometry=divide_curve.Points, Motion=negative)  # -> Geometry, Transform
line = Line(StartPoint=move_3.Geometry, EndPoint=move_4.Geometry)
loft = Loft(
    Curves=[move.Geometry, move_2.Geometry],
    Options={Adjust=False, Closed=False, LoftEnds=0, LoftSimp=0, LoftType=0, Rebuild=10, Refit=0.01})
dispatch = Dispatch(List=line, DispatchPattern=[Toggle(False), Toggle(True), Toggle(False)])  # -> ListA, ListB
curve = Curve(dispatch.ListB)
curve_2 = Curve(dispatch.ListA)
curve_middle = CurveMiddle(Curve=curve_2)
curve_middle_2 = CurveMiddle(Curve=curve)
point = Point(Point(0, 0, 0))
vector_2pt = Vector2Pt(PointA=point, PointB=curve_middle, Unitize=False)  # -> Vector, Length
vector_2pt_2 = Vector2Pt(PointA=point, PointB=curve_middle_2, Unitize=False)  # -> Vector, Length

ارتفاع_موج = Slider(1.85, range=1..2.2)
ارتفاع_موج_2 = Slider(1.1, range=1..2.2)

amplitude = Amplitude(Vector=vector_2pt.Vector, Amplitude=ارتفاع_موج)
amplitude_2 = Amplitude(Vector=vector_2pt_2.Vector, Amplitude=ارتفاع_موج_2)
move_5 = Move(Geometry=curve_2, Motion=amplitude)  # -> simplify(graft(Geometry)), Transform
move_6 = Move(Geometry=curve, Motion=amplitude_2)  # -> Geometry, Transform
partition_list = PartitionList(List=move_6.Geometry, Size="2")
cull_pattern = CullPattern(List=flatten(partition_list), CullPattern=[Toggle(False), Toggle(True)])  # -> simplify(graft(List))
cull_pattern_2 = CullPattern(List=flatten(partition_list), CullPattern=[Toggle(True), Toggle(False)])  # -> simplify(graft(List))
loft_2 = Loft(
    Curves=[cull_pattern_2, move_5.Geometry, cull_pattern],
    Options={Adjust=False, Closed=False, LoftEnds=0, LoftSimp=0, LoftType=0, Rebuild=10, Refit=0.01})
deconstruct_brep = DeconstructBrep(Brep=loft_2)  # -> Faces, simplify(Edges), Vertices
number_slider = Slider(0.5, range=0..1)
list_item = ListItem(List=deconstruct_brep.Edges, Index="0", Wrap=True)  # -> flatten(Item)
shift_list = ShiftList(List=list_item, Shift=1, Wrap=True)
blend_curve = BlendCurve(CurveA=list_item, CurveB=shift_list, BulgeA=number_slider, BulgeB=number_slider, Continuity=2)
join_curves = JoinCurves(Curves=[list_item, blend_curve], Preserve=False)  # -> graft(Curves)
xz_plane_2 = XZPlane(Origin=Point(0, 0, 0))
mirror = Mirror(Geometry=join_curves, Plane=xz_plane_2)  # -> Geometry, Transform
surface = Surface(loft)
loft_3 = Loft(
    Curves=[mirror.Geometry, join_curves],
    Options={Adjust=False, Closed=False, LoftEnds=0, LoftSimp=0, LoftType=0, Rebuild=10, Refit=0.01})  # -> flatten(Loft)
ضخامت_زیر_موج = Slider(0.967, range=0..1)
brep_join = BrepJoin(Breps=loft_3)  # -> Breps, Closed
deconstruct_brep_2 = DeconstructBrep(Brep=surface)  # -> Faces, simplify(Edges), Vertices
deconstruct_brep_3 = DeconstructBrep(Brep=loft_3)  # -> Faces, simplify(Edges), Vertices
xz_plane_3 = XZPlane(Origin=Point(0, 0, 0))
list_item_2 = ListItem(List=deconstruct_brep_2.Edges, Index="2", Wrap=True)  # -> simplify(flatten(Item))
list_item_3 = ListItem(List=deconstruct_brep_3.Edges, Index="5", Wrap=True)  # -> flatten(Item)
scale_nu = ScaleNU(Geometry=brep_join.Breps, Plane=xz_plane_3, ScaleX=ضخامت_زیر_موج, ScaleY=ضخامت_زیر_موج, ScaleZ=1)  # -> Geometry, Transform
join_curves_2 = JoinCurves(Curves=list_item_3, Preserve=False)  # -> simplify(flatten(Curves))
deconstruct_brep_4 = DeconstructBrep(Brep=brep_join.Breps)  # -> Faces, simplify(Edges), Vertices
deconstruct_brep_5 = DeconstructBrep(Brep=scale_nu.Geometry)  # -> Faces, simplify(Edges), Vertices
boundary_surfaces = BoundarySurfaces(Edges=join_curves_2)
ضخامت_دیواره = Slider(0.765, range=0..1)
list_item_4 = ListItem(List=deconstruct_brep_4.Edges, Index="1", Wrap=True)
list_item_5 = ListItem(List=deconstruct_brep_5.Edges, Index="1", Wrap=True)
xz_plane_4 = XZPlane(Origin=Point(0, 0, 0))
surface_split = SurfaceSplit(Surface=boundary_surfaces, Curves=list_item_2)
curve_middle_3 = CurveMiddle(Curve=list_item_4)
curve_middle_4 = CurveMiddle(Curve=list_item_5)
scale_nu_2 = ScaleNU(Geometry=scale_nu.Geometry, Plane=xz_plane_4, ScaleX=1, ScaleY=1, ScaleZ=ضخامت_دیواره)  # -> Geometry, Transform
xz_plane_5 = XZPlane(Origin=Point(0, 0, 0))
list_item_6 = ListItem(List=surface_split, Index="0", Wrap=True)
distance = Distance(PointA=curve_middle_3, PointB=curve_middle_4)  # -> simplify(flatten(Distance))
deconstruct_brep_6 = DeconstructBrep(Brep=scale_nu_2.Geometry)  # -> Faces, simplify(Edges), Vertices
mirror_2 = Mirror(Geometry=list_item_6, Plane=xz_plane_5)  # -> Geometry, Transform
list_item_7 = ListItem(List=deconstruct_brep_6.Edges, Index="1", Wrap=True)
curve_middle_5 = CurveMiddle(Curve=list_item_7)
distance_2 = Distance(PointA=curve_middle_4, PointB=curve_middle_5)  # -> simplify(flatten(Distance))

# ---- group: ضخامت زیر موج
panel = Panel(distance)

# ---- group: ضخامت دیواره
panel_2 = Panel(distance_2)

# ----
negative_2 = Negative(Value=distance_2)
xy_plane = XYPlane(Origin=Point(0, 0, 0))
offset_curve = OffsetCurve(Curve=list_item_2, Distance=negative_2, Plane=xy_plane, Corners=1)
surface_split_2 = SurfaceSplit(Surface=surface, Curves=offset_curve)
cull_index = CullIndex(List=surface_split_2, Indices="0", Wrap=True)
deconstruct_brep_7 = DeconstructBrep(Brep=cull_index)  # -> Faces, simplify(Edges), Vertices
xz_plane_6 = XZPlane(Origin=Point(0, 0, 0))
mirror_3 = Mirror(Geometry=cull_index, Plane=xz_plane_6)  # -> Geometry, Transform
list_item_8 = ListItem(List=deconstruct_brep_7.Edges, Index="2", Wrap=True)  # -> flatten(Item)
offset_curve_2 = OffsetCurve(Curve=list_item_8, Distance=ارتفاع_موج, Corners=1)  # -> flatten(Curve)
loft_4 = Loft(
    Curves=[list_item_8, offset_curve_2],
    Options={Adjust=False, Closed=False, LoftEnds=0, LoftSimp=0, LoftType=0, Rebuild=10, Refit=0.01})
brep = Brep(loft_4)
brep_brep = BrepBrep(BrepA=brep, BrepB=scale_nu_2.Geometry)  # -> Curves, Points
surface_split_3 = SurfaceSplit(Surface=brep, Curves=brep_brep.Curves)
cull_index_2 = CullIndex(List=surface_split_3, Indices="0", Wrap=True)
xz_plane_7 = XZPlane(Origin=Point(0, 0, 0))
mirror_4 = Mirror(Geometry=cull_index_2, Plane=xz_plane_7)  # -> Geometry, Transform
colour_picker = ColourPicker(PickedColour=RGB(206, 214, 133))
براقیت = Slider(42, range=0..100)
merge = Merge(
    Data1=brep_join.Breps,
    Data2=list_item_6,
    Data3=mirror_2.Geometry,
    Data4=cull_index_2,
    Data5=mirror_4.Geometry,
    Data6=mirror_3.Geometry,
    Data7=cull_index,
    Data8=scale_nu_2.Geometry)  # -> flatten(Result)
brep_join_2 = BrepJoin(Breps=merge)  # -> Breps, Closed
create_material = CreateMaterial(Diffuse=colour_picker, Specular=RGB(255, 255, 255), Emission=RGB(0, 0, 0), Transparency=0, Shine=براقیت)
custom_preview = CustomPreview(Geometry=brep_join_2.Breps, Material=create_material)
