# Grasshopper definition 23WavySrf.gh (Grasshopper 1.0.8)

number_slider = Slider(50, range=0..100)
multiplication = Multiplication(A=Slider(6, range=0..100), B="1")
circle = Circle(Plane=PlaneXY(0, 0, 0), Radius=Slider(53.5, range=0..100))
pi = Pi(Factor=multiplication)
subtraction = Subtraction(A=number_slider, B="1")
range = Range(Domain=pi, Steps=subtraction)
divide_curve = DivideCurve(Curve=circle, Count=number_slider, Kinks=False)  # -> Points, Tangents, Parameters
cosine = Cosine(Value=range)
multiplication_2 = Multiplication(A=cosine, B=Slider(13, range=0..100))
unit_z = UnitZ(Factor=multiplication_2)
move = Move(Geometry=divide_curve.Points, Motion=unit_z)  # -> Geometry, Transform
interpolate = Interpolate(Vertices=move.Geometry, Degree=3, Periodic=Toggle(True), KnotStyle=1)  # -> Curve, Length, Domain
number_slider_2 = Slider(0.5, range=0..1)
scale_nu = ScaleNU(
    Geometry=interpolate.Curve,
    Plane=PlaneXY(0, 0, 0),
    ScaleX=number_slider_2,
    ScaleY=number_slider_2,
    ScaleZ=Slider(1.62, range=0..10))  # -> Geometry, Transform
radians = Radians(Degrees=Slider(20, range=0..100))
number_slider_3 = Slider(100, range=0..100)
rotate = Rotate(Geometry=scale_nu.Geometry, Angle=radians, Plane=PlaneXY(0, 0, 0))  # -> Geometry, Transform
divide_curve_2 = DivideCurve(Curve=rotate.Geometry, Count=number_slider_3, Kinks=False)  # -> Points, Tangents, Parameters
divide_curve_3 = DivideCurve(Curve=interpolate.Curve, Count=number_slider_3, Kinks=False)  # -> Points, Tangents, Parameters
line = Line(StartPoint=divide_curve_2.Points, EndPoint=divide_curve_3.Points)
loft_options = LoftOptions(Closed=Toggle(True), Adjust=False, Rebuild=0, Refit=0, Type=0)
multiplication_3 = Multiplication(A=Slider(15, range=0..100), B="2")
loft = Loft(Curves=line, Options=loft_options)
addition = Addition(A=multiplication_3, B="1")
divide_domain² = DivideDomain²(Domain=loft, UCount=Slider(300, range=0..1000), VCount="1")
divide_domain²_2 = DivideDomain²(Domain=loft, UCount="1", VCount=addition)
isotrim = Isotrim(Surface=loft, Domain=divide_domain²)
isotrim_2 = Isotrim(Surface=loft, Domain=divide_domain²_2)
deconstruct_brep = DeconstructBrep(Brep=isotrim)  # -> Faces, Edges, Vertices
merge = Merge(Data1=Toggle(True), Data2=Toggle(False))
dispatch = Dispatch(List=isotrim_2, DispatchPattern=merge)  # -> ListA, ListB
number_slider_4 = Slider(0.3, range=0..1)
pipe = Pipe(Curve=deconstruct_brep.Edges, Radius=Slider(0.1, range=0..1), Caps=0)
negative = Negative(Value=number_slider_4)
offset_surface = OffsetSurface(Surface=dispatch.ListA, Distance=number_slider_4, Retrim=True)
offset_surface_2 = OffsetSurface(Surface=dispatch.ListA, Distance=negative, Retrim=True)
