# Grasshopper definition 24StepWalls.gh (Grasshopper 1.0.8)

number_slider = Slider(55.11, range=0..100)
number_slider_2 = Slider(39.14, range=0..100)
construct_domain = ConstructDomain(DomainStart=number_slider, DomainEnd=expr("-x", number_slider))
construct_domain_2 = ConstructDomain(DomainStart=number_slider_2, DomainEnd=expr("-x", number_slider_2))
rectangle = Rectangle(Plane=PlaneXY(0, 0, 0), XSize=construct_domain_2, YSize=construct_domain, Radius=0)  # -> Rectangle, Length
surface = Surface(rectangle.Rectangle)
number_slider_3 = Slider(12, range=0..100)
divide_domain² = DivideDomain²(Domain=surface, UCount=Slider(24, range=0..100), VCount=Slider(40, range=0..100))
md_slider = MDSlider(
    SliderMode=0,
    slider_value=Point(0.05222770967, 0.4837051019, 0.5),
    x_domain=Domain(0, 1),
    y_domain=Domain(0, 1),
    z_domain=Domain(0, 1))
divide_surface = DivideSurface(Surface=rectangle.Rectangle, UCount=number_slider_3, VCount=Slider(12, range=0..100))  # -> flatten(Points), Normals, Parameters
isotrim = Isotrim(Surface=surface, Domain=divide_domain²)
md_slider_2 = MDSlider(
    SliderMode=0,
    slider_value=Point(0.4569575612, 1, 0.5),
    x_domain=Domain(0, 1),
    y_domain=Domain(0, 1),
    z_domain=Domain(0, 1))
md_slider_3 = MDSlider(
    SliderMode=0,
    slider_value=Point(1, 0.5541138998, 0.5),
    x_domain=Domain(0, 1),
    y_domain=Domain(0, 1),
    z_domain=Domain(0, 1))
md_slider_4 = MDSlider(
    SliderMode=0,
    slider_value=Point(0.3242046077, 0, 0.5),
    x_domain=Domain(0, 1),
    y_domain=Domain(0, 1),
    z_domain=Domain(0, 1))
evaluate_surface = EvaluateSurface(Surface=reparameterize(rectangle.Rectangle), Point=[md_slider_2, md_slider_3, md_slider_4])  # -> Point, Normal, UDirection, VDirection, Frame
evaluate_surface_2 = EvaluateSurface(Surface=reparameterize(rectangle.Rectangle), Point=md_slider)  # -> Point, Normal, UDirection, VDirection, Frame
pull_point = PullPoint(Point=divide_surface.Points, Geometry=evaluate_surface.Point, ClosestOnly=True)  # -> ClosestPoint, Distance, Index
pull_point_2 = PullPoint(Point=divide_surface.Points, Geometry=evaluate_surface_2.Point, ClosestOnly=True)  # -> ClosestPoint, Distance, Index
minimum = Minimum(A=pull_point.Distance, B=Slider(12.64, range=0..100))
minimum_2 = Minimum(A=pull_point_2.Distance, B=Slider(12.64, range=0..100))
bounds = Bounds(Numbers=minimum)
bounds_2 = Bounds(Numbers=minimum_2)
remap_numbers = RemapNumbers(Value=minimum, Source=bounds, Target=Domain(0, 1))  # -> Mapped, Clipped
remap_numbers_2 = RemapNumbers(Value=minimum_2, Source=bounds_2, Target=Domain(0, 1))  # -> Mapped, Clipped
graph_mapper = GraphMapper(
    remap_numbers.Mapped,
    x0=0,
    x1=1,
    y0=0,
    y1=1,
    container_name="Bezier",
    cpx=[0, 0.6784915924, 0.4407233596, 1],
    cpy=[0, 0, 0.7569677234, 1])
graph_mapper_2 = GraphMapper(
    remap_numbers_2.Mapped,
    x0=0,
    x1=1,
    y0=0,
    y1=1,
    container_name="Bezier",
    cpx=[0, 0.6784915924, 0.4407233596, 1],
    cpy=[0, 0, 0.7569677234, 1])
construct_domain_3 = ConstructDomain(DomainStart=Slider(2.51, range=0..100), DomainEnd=Slider(26.32, range=0..100))
bounds_3 = Bounds(Numbers=graph_mapper)
construct_domain_4 = ConstructDomain(DomainStart=Slider(13.47, range=0..100), DomainEnd=Slider(0, range=0..100))
bounds_4 = Bounds(Numbers=graph_mapper_2)
cluster_remap = ClusterRemap(data=graph_mapper, min=bounds_3, max=construct_domain_3)
unit_z = UnitZ(Factor=cluster_remap)
move = Move(Geometry=divide_surface.Points, Motion=unit_z)  # -> Geometry, Transform
cluster_remap_2 = ClusterRemap(data=graph_mapper_2, min=bounds_4, max=construct_domain_4)
unit_z_2 = UnitZ(Factor=cluster_remap_2)
move_2 = Move(Geometry=move.Geometry, Motion=unit_z_2)  # -> Geometry, Transform
area = Area(Geometry=isotrim)  # -> Area, Centroid
surface_from_points = SurfaceFromPoints(Points=move_2.Geometry, UCount=expr("x+1", number_slider_3), Interpolate=False)
box_rectangle = BoxRectangle(Rectangle=isotrim, Height=Slider(5.05, range=0..100))
unit_z_3 = UnitZ(Factor=1)
line_sdl = LineSDL(Start=area.Centroid, Direction=unit_z_3, Length=Slider(33.33, range=0..100))
unit_z_4 = UnitZ(Factor=Slider(3.88, range=0..100))
extrude = Extrude(Base=surface_from_points, Direction=unit_z_4)
brep_line = BrepLine(Brep=surface_from_points, Line=line_sdl, LimitToFirst=False)  # -> Curves, flatten(Points)
orient = Orient(Geometry=box_rectangle, Source=area.Centroid, Target=brep_line.Points)  # -> Geometry, Transform

# ==== cluster ClusterRemap
data = ClusterInput()
min = ClusterInput()
max = ClusterInput()
number = Number(data)
construct_domain = ConstructDomain(DomainStart=min, DomainEnd=max)
bounds = Bounds(Numbers=number)
remap_numbers = RemapNumbers(Value=data, Source=bounds, Target=construct_domain)  # -> Mapped, Clipped
data_2 = ClusterOutput(remap_numbers.Mapped)
