# Grasshopper definition 25SpiralPavilion.gh (Grasshopper 1.0.8)

number_slider = Slider(200, range=0..1000)
construct_domain = ConstructDomain(DomainStart=Slider(1.8, range=0..10), DomainEnd=Slider(15, range=0..100))
pi = Pi(Factor=Slider(5, range=0..20))
point = Point(Point(0, 0, 0))
range = Range(Domain=pi, Steps=number_slider)
xy_plane = XYPlane(Origin=point)
range_2 = Range(Domain=construct_domain, Steps=number_slider)
point_cylindrical = PointCylindrical(BasePlane=xy_plane, Angle=range, Radius=range_2, Elevation=0)
rotate = Rotate(Geometry=point_cylindrical, Angle=degrees(Slider(180, range=0..1000)), Plane=PlaneXY(0, 0, 0))  # -> Geometry, Transform
nurbs_curve = NurbsCurve(Vertices=point_cylindrical, Degree=3, Periodic=False)  # -> Curve, Length, Domain
nurbs_curve_2 = NurbsCurve(Vertices=rotate.Geometry, Degree=3, Periodic=False)  # -> Curve, Length, Domain
merge = Merge(Data1=nurbs_curve.Curve, Data2=nurbs_curve_2.Curve)
xy_plane_2 = XYPlane(Origin=point)
rotate_plane = RotatePlane(Plane=xy_plane_2, Angle=degrees(Slider(45, range=0..1000)))
scale_nu = ScaleNU(Geometry=merge, Plane=rotate_plane, ScaleX=Slider(1.3, range=0..10), ScaleY=Slider(1, range=0..10), ScaleZ=1)  # -> Geometry, Transform
evaluate_curve = EvaluateCurve(Curve=scale_nu.Geometry, Parameter="0")  # -> Point, Tangent, Angle
explode_tree = ExplodeTree(Data=scale_nu.Geometry)  # -> Branch0, Branch1
unit_z = UnitZ(Factor=1)
entwine = Entwine(Branch00=explode_tree.Branch1, Branch01=explode_tree.Branch0, FlattenInputs=True)
cross_product = CrossProduct(VectorA=evaluate_curve.Tangent, VectorB=unit_z, Unitize=False)  # -> Vector, Length
project_point = ProjectPoint(Point=evaluate_curve.Point, Direction=cross_product.Vector, Geometry=entwine)  # -> Point, Index
curve_closest_point = CurveClosestPoint(Point=project_point.Point, Curve=entwine)  # -> Point, Parameter, Distance
addition = Addition(A=curve_closest_point.Parameter, B=Slider(34.06, range=0..100))
shatter = Shatter(Curve=entwine, Parameters=addition)
length = Length(Curve=shatter)
sort_list = SortList(Keys=length, ValuesA=shatter)  # -> Keys, reverse(ValuesA)
list_item = ListItem(List=sort_list.ValuesA, Index=0, Wrap=True)
number_slider_2 = Slider(200, range=0..1000)
horizontal_frames = HorizontalFrames(Curve=list_item, Count=number_slider_2)  # -> Frames, Parameters
deconstruct_plane = DeconstructPlane(Plane=horizontal_frames.Frames)  # -> Origin, XAxis, YAxis, ZAxis
project_point_2 = ProjectPoint(Point=deconstruct_plane.Origin, Direction=deconstruct_plane.YAxis, Geometry=scale_nu.Geometry)  # -> Point, Index
line = Line(StartPoint=project_point_2.Point, EndPoint=deconstruct_plane.Origin)
range_3 = Range(Domain="0 to 1", Steps=number_slider_2)
graph_mapper = GraphMapper(range_3, x0=0, x1=1, y0=0, y1=1, container_name="Gaussian", factor=0.1841890812, mean=0.5297816396, sdev=0.1)
number_slider_3 = Slider(3.23, range=0..10)
cluster_remap = ClusterRemap(data=graph_mapper, min=number_slider_3, max=Slider(9.44, range=0..100))
unit_z_2 = UnitZ(Factor=cluster_remap)
move = Move(Geometry=line, Motion=unit_z_2)  # -> Geometry, Transform
loft = Loft(Curves=line, Options={Adjust=False, Closed=False, LoftEnds=0, LoftSimp=0, LoftType=0, Rebuild=10, Refit=0.01})
loft_2 = Loft(Curves=move.Geometry, Options={Adjust=False, Closed=False, LoftEnds=0, LoftSimp=0, LoftType=0, Rebuild=10, Refit=0.01})
region_union = RegionUnion(Curves=flatten(loft))
curve = Curve(loft)
curve_2 = Curve(loft_2)
area = Area(Geometry=region_union)  # -> Area, Centroid
sort_list_2 = SortList(Keys=area.Area, ValuesA=region_union)  # -> Keys, reverse(ValuesA)
list_item_2 = ListItem(List=sort_list_2.ValuesA, Index="0", Wrap=True)
list_item_3 = ListItem(List=sort_list_2.ValuesA, Index="1", Wrap=True)
boundary_surfaces = BoundarySurfaces(Edges=list_item_2)
unit_z_3 = UnitZ(Factor=number_slider_3)
move_2 = Move(Geometry=list_item_3, Motion=unit_z_3)  # -> Geometry, Transform
boundary_surfaces_2 = BoundarySurfaces(Edges=move_2.Geometry)
ruled_surface = RuledSurface(CurveA=curve, CurveB=curve_2)
merge_2 = Merge(Data1=loft_2, Data2=boundary_surfaces_2)  # -> flatten(Result)
brep_join = BrepJoin(Breps=merge_2)  # -> Breps, Closed
custom_preview = CustomPreview(Geometry=[boundary_surfaces, brep_join.Breps, ruled_surface], Material=ColourSwatch(SwatchColor=RGB(41, 105, 148)))

# ==== cluster ClusterRemap
data = ClusterInput()
min = ClusterInput()
max = ClusterInput()
number = Number(data)
construct_domain = ConstructDomain(DomainStart=min, DomainEnd=max)
bounds = Bounds(Numbers=number)
remap_numbers = RemapNumbers(Value=data, Source=bounds, Target=construct_domain)  # -> Mapped, Clipped
data_2 = ClusterOutput(remap_numbers.Mapped)
