# Grasshopper definition 26Tent.gh (Grasshopper 1.0.8)

construct_point = ConstructPoint(XCoordinate=Slider(2.33, range=0..10), YCoordinate=0, ZCoordinate=Slider(10, range=0..100))
unit_x = UnitX(Factor=1)
number_slider = Slider(31, range=0..100)
line_sdl = LineSDL(Start=construct_point, Direction=unit_x, Length=Slider(32.55, range=0..100))
range = Range(Domain=Domain(0, 1), Steps=number_slider)
divide_curve = DivideCurve(Curve=line_sdl, Count=number_slider, Kinks=False)  # -> Points, Tangents, Parameters
graph_mapper = GraphMapper(range, x0=0, x1=1, y0=0, y1=1, Cx=0.6188787818, Cy=0.3832057118, container_name="Conic")
multiplication = Multiplication(A=graph_mapper, B=Slider(33.48, range=0..100))
unit_z = UnitZ(Factor=reverse(multiplication))
number_slider_2 = Slider(20, range=0..100)
move = Move(Geometry=divide_curve.Points, Motion=unit_z)  # -> Geometry, Transform
expression = Expression(x=number_slider_2, Expression="360/x")
interpolate = Interpolate(Vertices=move.Geometry, Degree=3, Periodic=False, KnotStyle=1)  # -> Curve, Length, Domain
series = Series(Start=0, Step=number_slider_2, Count=expression)
rotate = Rotate(Geometry=interpolate.Curve, Angle=degrees(series), Plane=PlaneXY(0, 0, 0))  # -> Geometry, Transform
construct_domain = ConstructDomain(DomainStart=Slider(0, range=0..100), DomainEnd=Slider(5, range=0..100))
divide_curve_2 = DivideCurve(Curve=rotate.Geometry, Count=Slider(20, range=0..100), Kinks=False)  # -> Points, Tangents, Parameters
range_2 = Range(Domain=construct_domain, Steps=10)
offset_curve = OffsetCurve(Curve=rotate.Geometry, Distance=Slider(1.84, range=0..10), Corners=1)
cull_index = CullIndex(List=divide_curve_2.Points, Indices=range_2, Wrap=True)
flip_matrix = FlipMatrix(Data=cull_index)
merge = Merge(Data1=simplify(graft(rotate.Geometry)), Data2=simplify(graft(offset_curve)))
polyline = PolyLine(Vertices=flip_matrix, Closed=Toggle(True))
divide_curve_3 = DivideCurve(Curve=offset_curve, Count=Slider(10, range=0..100), Kinks=False)  # -> Points, Tangents, Parameters
loft = Loft(Curves=merge, Options={Adjust=False, Closed=False, LoftEnds=0, LoftSimp=0, LoftType=0, Rebuild=10, Refit=0.01})
explode = Explode(Curve=flatten(polyline), Recursive=True)  # -> Segments, Vertices
project_along = ProjectAlong(Geometry=divide_curve_3.Points, Plane=PlaneXY(0, 0, 0), Direction=Vector(0, 0, -1))  # -> Geometry, Transform
custom_preview = CustomPreview(Geometry=loft, Material=ColourSwatch(SwatchColor=RGB(65, 131, 163)))
negative = Negative(Value=Slider(5, range=0..10))
curve_middle = CurveMiddle(Curve=explode.Segments)
line = Line(StartPoint=divide_curve_3.Points, EndPoint=project_along.Geometry)
unit_z_2 = UnitZ(Factor=negative)
move_2 = Move(Geometry=curve_middle, Motion=unit_z_2)  # -> Geometry, Transform
end_points = EndPoints(Curve=explode.Segments)  # -> Start, End
pipe = Pipe(Curve=line, Radius=Slider(0.3, range=0..1), Caps="1")
merge_2 = Merge(Data1=simplify(graft(end_points.Start)), Data2=simplify(graft(move_2.Geometry)), Data3=simplify(graft(end_points.End)))
custom_preview_2 = CustomPreview(Geometry=pipe, Material=ColourSwatch(SwatchColor=RGB(97, 49, 49)))
interpolate_2 = Interpolate(Vertices=merge_2, Degree=3, Periodic=False, KnotStyle=1)  # -> Curve, Length, Domain
join_curves = JoinCurves(Curves=flatten(interpolate_2.Curve), Preserve=False)
dispatch = Dispatch(List=reverse(join_curves), DispatchPattern=[True, False])  # -> ListA, ListB
dispatch_2 = Dispatch(List=join_curves, DispatchPattern=[True, False])  # -> ListA, ListB
curve = Curve(dispatch_2.ListA)
curve_2 = Curve(dispatch_2.ListB)
curve_3 = Curve(dispatch.ListA)
curve_4 = Curve(dispatch.ListB)
merge_3 = Merge(Data1=simplify(graft(curve)), Data2=simplify(graft(curve_2)))
merge_4 = Merge(Data1=simplify(graft(curve_3)), Data2=simplify(graft(curve_4)))
loft_2 = Loft(Curves=merge_3, Options={Adjust=False, Closed=False, LoftEnds=0, LoftSimp=0, LoftType=0, Rebuild=10, Refit=0.01})
loft_3 = Loft(Curves=merge_4, Options={Adjust=False, Closed=False, LoftEnds=0, LoftSimp=0, LoftType=0, Rebuild=10, Refit=0.01})
custom_preview_3 = CustomPreview(Geometry=loft_3, Material=ColourSwatch(SwatchColor=RGB(178, 135, 96)))
custom_preview_4 = CustomPreview(Geometry=loft_2, Material=ColourSwatch(SwatchColor=RGB(80, 163, 163)))
