# Grasshopper definition 28Faced.gh (Grasshopper 1.0.8)
# plug-ins: LunchBox, Weaverbird

surface = Surface(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)
diamond_panels = DiamondPanels(Surface=surface, UDivisions=Slider(20, range=0..100), VDivisions=Slider(20, range=0..100))  # -> DiamondPanels, TriPanels
area = Area(Geometry=diamond_panels.DiamondPanels)  # -> Area, Centroid
deconstruct_brep = DeconstructBrep(Brep=diamond_panels.DiamondPanels)  # -> Faces, simplify(Edges), Vertices
surface_closest_point = SurfaceClosestPoint(Point=area.Centroid, Surface=surface)  # -> Point, UVPoint, Distance
image_sampler = ImageSampler(
    surface_closest_point.UVPoint,
    FilePath="C:\Users\Tolu\Pictures\Saved Pictures\radial-gradient-reversed.jpg",
    Filter="Value",
    Interpolate=True,
    Umax=1,
    Umin=0,
    Vmax=1,
    Vmin=0,
    Wrap=1)
evaluate_surface = EvaluateSurface(Surface=surface, Point=surface_closest_point.UVPoint)  # -> Point, Normal, UDirection, VDirection, Frame
multiplication = Multiplication(A=image_sampler, B=Slider(8.75, range=0..15))
multiplication_2 = Multiplication(A=evaluate_surface.Normal, B=multiplication)
move = Move(Geometry=area.Centroid, Motion=multiplication_2)  # -> Geometry, Transform
merge = Merge(Data1=deconstruct_brep.Vertices, Data2=graft(move.Geometry))
plane_normal = PlaneNormal(Origin=Point(0, 0, 0), ZAxis=evaluate_surface.Normal)
delaunay_mesh = DelaunayMesh(Points=merge, Plane=graft(plane_normal))
simple_mesh = SimpleMesh(Brep=diamond_panels.TriPanels)
merge_2 = Merge(Data1=simple_mesh, Data2=delaunay_mesh)  # -> flatten(Result)
weaverbird_s_join_meshes_and_weld = WeaverbirdsJoinMeshesAndWeld(Mesh=flatten(merge_2), Weld=Toggle(True))
weaverbird_s_catmull_clark_subdivision = WeaverbirdsCatmullClarkSubdivision(MeshCurves=weaverbird_s_join_meshes_and_weld, Level=Slider(3, range=1..3), SmoothNakedEdges="0")
custom_preview = CustomPreview(Geometry=weaverbird_s_catmull_clark_subdivision, Material=ColourSwatch(SwatchColor=RGB(76, 145, 117)))
