# Grasshopper definition 29DifPattern.gh (Grasshopper 1.0.8)
# plug-ins: LunchBox

unit_z = UnitZ(Factor=1)
vector = Vector(Vector(-28.6650317, 6.114712994, 0))
point = Point(Point(-9.995592471, 9.948534991, 0))
construct_plane = ConstructPlane(Origin=point, XAxis=vector, YAxis=unit_z)
construct_domain = ConstructDomain(DomainStart=Slider(0, range=0..100), DomainEnd=Slider(28.2, range=0..100))
construct_domain_2 = ConstructDomain(DomainStart=Slider(0, range=0..100), DomainEnd=Slider(82.2, range=0..150))
rectangle = Rectangle(Plane=construct_plane, XSize=construct_domain, YSize=construct_domain_2, Radius=0)  # -> Rectangle, Length
boundary_surfaces = BoundarySurfaces(Edges=rectangle.Rectangle)
transpose_surface = TransposeSurface(Surface=boundary_surfaces)  # -> Surface, U, V
number_slider = Slider(44, range=0..100)
expression = Expression(Expression="1/3")
hexagon_cells = HexagonCells(Surface=transpose_surface.Surface, UDivisions=number_slider, VDivisions=Slider(12, range=0..100), TParameter=expression)  # -> HexagonCells, Centers
discontinuity = Discontinuity(Curve=hexagon_cells.HexagonCells, Level=1)  # -> Points, Parameters
list_length = ListLength(List=discontinuity.Points)
equality = Equality(FirstNumber=list_length, SecondNumber="6")  # -> flatten(Equality), Inequality
cull_pattern = CullPattern(List=hexagon_cells.HexagonCells, CullPattern=equality.Equality)
cull_pattern_2 = CullPattern(List=hexagon_cells.Centers, CullPattern=equality.Equality)
bounding_box = BoundingBox(Content=cull_pattern_2, Plane=construct_plane, UnionBox=True)  # -> Box, Box_2
surface = Surface(bounding_box.Box)
curve = Curve(surface)
point_in_curve = PointInCurve(Point=cull_pattern_2, Curve=curve)  # -> Relationship, Point
equality_2 = Equality(FirstNumber=point_in_curve.Relationship, SecondNumber="2")  # -> Equality, Inequality
cull_pattern_3 = CullPattern(List=cull_pattern_2, CullPattern=equality_2.Equality)
bounding_box_2 = BoundingBox(Content=cull_pattern_3, Plane=construct_plane, UnionBox=True)  # -> Box, Box_2
surface_2 = Surface(bounding_box_2.Box)
box_morph = BoxMorph(Geometry=cull_pattern, Reference=surface_2, Target=rectangle.Rectangle)
number_slider_2 = Slider(0.333, range=0..1)
explode = Explode(Curve=box_morph, Recursive=True)  # -> Segments, Vertices
expression_2 = Expression(x=number_slider_2, Expression="1+x")
expression_3 = Expression(x=number_slider_2, Expression="1-x")
explode_2 = Explode(Curve=box_morph, Recursive=True)  # -> flatten(Segments), Vertices
curve_middle = CurveMiddle(Curve=explode.Segments)
merge = Merge(Data1=expression_2, Data2=expression_3)
length = Length(Curve=explode_2.Segments)
repeat_data = RepeatData(Data=merge, Length="6")
average = Average(Input=curve_middle)
bounds = Bounds(Numbers=length)
scale = Scale(Geometry=curve_middle, Center=average, Factor=repeat_data)  # -> Geometry, Transform
deconstruct_domain = DeconstructDomain(Domain=bounds)  # -> Start, End
discontinuity_2 = Discontinuity(Curve=box_morph, Level=1)  # -> Points, Parameters
subtraction = Subtraction(A=deconstruct_domain.Start, B=deconstruct_domain.End)
panel = Panel("""1
0""")
absolute = Absolute(Value=subtraction)
weave = Weave(Pattern=panel, Stream0=scale.Geometry, Stream1=discontinuity_2.Points, NullGaps=False)
galapagos = Galapagos(fitness=absolute, gene=number_slider)
panel_2 = Panel(absolute)
shift_list = ShiftList(List=weave, Shift=Slider(1, range=0..1), Wrap=True)
polyline = PolyLine(Vertices=shift_list, Closed=invert(False))
explode_3 = Explode(Curve=polyline, Recursive=True)  # -> Segments, Vertices
explode_4 = Explode(Curve=polyline, Recursive=True)  # -> Segments, Vertices
curve_middle_2 = CurveMiddle(Curve=explode_4.Segments)
partition_list = PartitionList(List=explode_3.Segments, Size="2")
average_2 = Average(Input=curve_middle_2)
join_curves = JoinCurves(Curves=partition_list, Preserve=False)  # -> simplify(Curves)
scale_2 = Scale(Geometry=curve_middle_2, Center=average_2, Factor=Slider(0.658, range=0..1))  # -> Geometry, Transform
polygon_center = PolygonCenter(Polyline=polyline)  # -> simplify(CenterV), CenterE, CenterA
split_tree = SplitTree(Data=join_curves, Masks=flatten("{*;0,2,...}"))  # -> Positive, Negative
param_viewer = ParamViewer(join_curves)
point_list = PointList(Points=scale_2.Geometry, Size=Slider(0.27, range=0..1))
deconstruct = Deconstruct(Point=polygon_center.CenterV)  # -> XComponent, YComponent, ZComponent
op = Slider(0.932, range=0..2)
polygon_center_2 = PolygonCenter(Polyline=polyline)  # -> CenterV, CenterE, CenterA
bounds_2 = Bounds(Numbers=flatten(deconstruct.ZComponent))
repeat_data_2 = RepeatData(Data=polygon_center_2.CenterV, Length="6")  # -> simplify(graft(Data))
curve_2 = Curve(split_tree.Positive)
deconstruct_domain_2 = DeconstructDomain(Domain=bounds_2)  # -> Start, End
split_tree_2 = SplitTree(Data=repeat_data_2, Masks=flatten("{*;0,2,...}"))  # -> Positive, Negative
multiplication = Multiplication(A=deconstruct_domain_2.End, B=op)
panel_3 = Panel(deconstruct_domain_2.End)
end_points = EndPoints(Curve=curve_2)  # -> Start, End
curve_3 = Curve(split_tree.Negative)
construct_domain_3 = ConstructDomain(DomainStart=deconstruct_domain_2.Start, DomainEnd=multiplication)
construct_domain_4 = ConstructDomain(DomainStart=Slider(0.1, range=0..1), DomainEnd=Slider(1, range=0..1))
line = Line(StartPoint=end_points.End, EndPoint=split_tree_2.Positive)
end_points_2 = EndPoints(Curve=curve_3)  # -> Start, End
panel_4 = Panel(construct_domain_3)
merge_2 = Merge(Data1=line, Data2=curve_2)
remap_numbers = RemapNumbers(Value=deconstruct.ZComponent, Source=construct_domain_3, Target=construct_domain_4)  # -> Mapped, Clipped
line_2 = Line(StartPoint=end_points_2.Start, EndPoint=split_tree_2.Negative)
join_curves_2 = JoinCurves(Curves=merge_2, Preserve=False)
merge_3 = Merge(Data1=line_2, Data2=curve_3)
repeat_data_3 = RepeatData(Data=remap_numbers.Clipped, Length="6")  # -> simplify(graft(Data))
join_curves_3 = JoinCurves(Curves=merge_3, Preserve=False)
merge_4 = Merge(Data1=join_curves_2, Data2=join_curves_3)
explode_5 = Explode(Curve=merge_4, Recursive=True)  # -> Segments, Vertices
number = Number(repeat_data_3)
expression_4 = Expression(x=number, Expression="1-x")
panel_5 = Panel("""1
0""")
cull_pattern_4 = CullPattern(List=explode_5.Segments, CullPattern=panel_5)
merge_5 = Merge(Data1=expression_4, Data2=number)
evaluate_curve = EvaluateCurve(Curve=reparameterize(cull_pattern_4), Parameter=merge_5)  # -> Point, Tangent, Angle
polyline_2 = PolyLine(Vertices=evaluate_curve.Point, Closed=False)
curve_curve = CurveCurve(CurveA=merge_4, CurveB=polyline_2)  # -> Points, ParamsA, ParamsB
shatter = Shatter(Curve=merge_4, Parameters=curve_curve.ParamsA)
list_item = ListItem(List=shatter, Index="1", Wrap=True)
merge_6 = Merge(Data1=simplify(list_item), Data2=simplify(polyline_2))
join_curves_4 = JoinCurves(Curves=merge_6, Preserve=False)
param_viewer_2 = ParamViewer(merge_6)
boundary_surfaces_2 = BoundarySurfaces(Edges=join_curves_4)
data_dam = DataDam(DataA=boundary_surfaces_2, BufferDelay=2500000, BufferMode=1)
region_intersection = RegionIntersection(CurvesA=data_dam, CurvesB=rectangle.Rectangle)
clean_tree = CleanTree(RemoveNulls=True, RemoveInvalid=True, RemoveEmpty=invert(False), Tree=region_intersection)
boundary_surfaces_3 = BoundarySurfaces(Edges=clean_tree)
