# Grasshopper definition 30CP.gh (Grasshopper 1.0.8)
# plug-ins: Pufferfish, LunchBox, Weaverbird

xz_plane = XZPlane(Origin=Point(0, 0, 0))
number_slider = Slider(10, range=0..100)
plane_surface = PlaneSurface(Plane=xz_plane, XSize=Domain(-10, 10), YSize=Domain(-10, 10))
quad_panels = QuadPanels(Surface=plane_surface, UDivisions=number_slider, VDivisions=number_slider)
area = Area(Geometry=quad_panels)  # -> Area, Centroid
point = Point(Point(0.5101078071, 0, 0.8492283653))
closest_points = ClosestPoints(Point=point, Cloud=area.Centroid, Count=Slider(7, range=0..100))  # -> ClosestPoint, CPIndex, Distance
create_set = CreateSet(List=area.Centroid)  # -> Set, Map
set_difference_s = SetDifferenceS(SetA=create_set.Map, SetB=closest_points.CPIndex)
list_item = ListItem(List=quad_panels, Index=closest_points.CPIndex, Wrap=True)
number_slider_2 = Slider(7.5, range=0..10)
simple_mesh = SimpleMesh(Brep=list_item)
list_item_2 = ListItem(List=quad_panels, Index=set_difference_s, Wrap=True)
weaverbird_s_mesh_window = WeaverbirdsMeshWindow(MeshPolylines=simple_mesh, Distance=number_slider_2, InsetType=0)
weaverbird_s_picture_frame = WeaverbirdsPictureFrame(MeshPolylines=simple_mesh, Distance=number_slider_2, InsetType=0)
custom_preview = CustomPreview(Geometry=list_item_2, Material=ColourSwatch(SwatchColor=RGB(100, 130, 40)))
area_2 = Area(Geometry=weaverbird_s_mesh_window)  # -> Area, Centroid
custom_preview_2 = CustomPreview(Geometry=weaverbird_s_picture_frame, Material=ColourSwatch(SwatchColor=RGB(135, 53, 53)))
yz_plane = YZPlane(Origin=area_2.Centroid)
rotate = Rotate(Geometry=weaverbird_s_mesh_window, Angle=degrees(Slider(34, range=0..90)), Plane=yz_plane)  # -> Geometry, Transform
offset_mesh = OffsetMesh(Mesh=rotate.Geometry, Distance=Slider(0.1, range=0..1), BothSides=0, CreateSolid=True)
custom_preview_3 = CustomPreview(Geometry=offset_mesh, Material=ColourSwatch(SwatchColor=RGB(90, 161, 156)))
