# Grasshopper definition 31MovingLoop.gh (Grasshopper 1.0.8)

trigger = Trigger(Interval=10, TimerInterval=10, Target=number)
number = Number(Slider(0.005, range=0..1))
data_recorder = DataRecorder(number, DataLimit=-10, RecordData=True)
mass_addition = MassAddition(Input=data_recorder)  # -> Result, PartialResults
modulus = Modulus(A=mass_addition.Result, B="1")
curve = Curve(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)
evaluate_curve = EvaluateCurve(Curve=reparameterize(curve), Parameter=modulus)  # -> Point, Tangent, Angle
