# Grasshopper definition 32GhArena.gh (Grasshopper 1.0.8)
# plug-ins: LunchBox

number_slider = Slider(12, range=0..100)
series = Series(Start=0, Step=Slider(3, range=0..10), Count=number_slider)
expression = Expression(x=number_slider, Expression="x-1")
construct_point = ConstructPoint(XCoordinate=0, YCoordinate=0, ZCoordinate=series)
range = Range(Domain=Domain(0, 1), Steps=expression)
xy_plane = XYPlane(Origin=construct_point)
graph_mapper = GraphMapper(range, x0=0, x1=1, y0=0, y1=1, Ox=0.5027731061, Oy=1, Px=1, Py=0.2427708507, container_name="Parabola")
ellipse = Ellipse(Plane=xy_plane, Radius1=Slider(50, range=0..100), Radius2=Slider(29.56, range=0..100))  # -> Ellipse, Focus1, Focus2
negative = Negative(Value=Slider(10, range=0..100))
multiplication = Multiplication(A=graph_mapper, B=Slider(0.22, range=0..1))
area = Area(Geometry=ellipse.Ellipse)  # -> Area, Centroid
addition = Addition(A=multiplication, B="1")
offset_curve = OffsetCurve(Curve=ellipse.Ellipse, Distance=negative, Corners=1)
scale = Scale(Geometry=ellipse.Ellipse, Center=area.Centroid, Factor=addition)  # -> Geometry, Transform
loft = Loft(
    Curves=flatten(offset_curve),
    Options={Adjust=False, Closed=False, LoftEnds=0, LoftSimp=0, LoftType=0, Rebuild=10, Refit=0.01})
solid_difference = SolidDifference(BrepsA=graft(ellipse.Ellipse), BrepsB=offset_curve)
loft_2 = Loft(Curves=scale.Geometry, Options={Adjust=False, Closed=False, LoftEnds=0, LoftSimp=0, LoftType=0, Rebuild=10, Refit=0.01})
triangle_panels_b = TrianglePanelsB(Surface=loft, UDivisions=Slider(10, range=0..100), VDivisions=Slider(40, range=0..100))
quad_panels = QuadPanels(Surface=loft_2, UDivisions=Slider(5, range=0..100), VDivisions=Slider(50, range=0..100))
negative_2 = Negative(Value=Slider(0.5, range=0..1))
deconstruct_brep = DeconstructBrep(Brep=flatten(triangle_panels_b))  # -> Faces, Edges, Vertices
unit_z = UnitZ(Factor=negative_2)
deconstruct_brep_2 = DeconstructBrep(Brep=flatten(quad_panels))  # -> Faces, Edges, Vertices
list_item = ListItem(List=deconstruct_brep.Vertices, Index=0, Wrap=True)  # -> Item, Item1, Item2
curve = Curve(deconstruct_brep.Faces)
list_item_2 = ListItem(List=deconstruct_brep_2.Vertices, Index=0, Wrap=True)  # -> Item, Item1, Item2, Item3
curve_2 = Curve(deconstruct_brep_2.Faces)
project = Project(Geometry=list_item.Item, Plane=PlaneXY(0, 0, 0))  # -> Geometry, Transform
construct_point_2 = ConstructPoint(XCoordinate=0, YCoordinate=0, ZCoordinate=0)
project_2 = Project(Geometry=list_item_2.Item, Plane=PlaneXY(0, 0, 0))  # -> Geometry, Transform
construct_point_3 = ConstructPoint(XCoordinate=0, YCoordinate=0, ZCoordinate=0)
vector_2pt = Vector2Pt(PointA=simplify(graft(project.Geometry)), PointB=simplify(graft(construct_point_2)), Unitize=False)  # -> Vector, Length
vector_2pt_2 = Vector2Pt(PointA=simplify(graft(project_2.Geometry)), PointB=simplify(graft(construct_point_3)), Unitize=False)  # -> Vector, Length
amplitude = Amplitude(Vector=vector_2pt.Vector, Amplitude=Slider(4, range=0..10))
amplitude_2 = Amplitude(Vector=vector_2pt_2.Vector, Amplitude=Slider(2.5, range=0..10))
move = Move(Geometry=simplify(graft(list_item.Item)), Motion=simplify(graft(amplitude)))  # -> Geometry, Transform
move_2 = Move(Geometry=simplify(graft(list_item_2.Item)), Motion=simplify(graft(amplitude_2)))  # -> Geometry, Transform
merge = Merge(Data1=simplify(graft(move.Geometry)), Data2=simplify(graft(list_item.Item1)), Data3=simplify(graft(list_item.Item2)))
line = Line(StartPoint=list_item.Item, EndPoint=move.Geometry)
polyline = PolyLine(Vertices=merge, Closed=invert(False))
merge_2 = Merge(
    Data1=simplify(graft(move_2.Geometry)),
    Data2=simplify(graft(list_item_2.Item1)),
    Data3=simplify(graft(list_item_2.Item2)),
    Data4=simplify(graft(list_item_2.Item3)))
line_2 = Line(StartPoint=list_item_2.Item, EndPoint=move_2.Geometry)
polyline_2 = PolyLine(Vertices=merge_2, Closed=invert(False))
merge_3 = Merge(Data1=curve, Data2=line, Data3=polyline)
patch = Patch(Curves=polyline, Spans=20, Flexibility=1, Trim=True)
merge_4 = Merge(Data1=curve_2, Data2=line_2, Data3=polyline_2)
patch_2 = Patch(Curves=polyline_2, Spans=20, Flexibility=1, Trim=True)
area_2 = Area(Geometry=patch_2)  # -> Area, Centroid
pipe = Pipe(Curve=[merge_4, merge_3], Radius=Slider(0.08, range=0..0.1), Caps="1")
point = Point(Point(-53.2913277, 45.49969798, 0))
closest_points = ClosestPoints(Point=point, Cloud=area_2.Centroid, Count=3)  # -> ClosestPoint, CPIndex, Distance
extrude = Extrude(Base=solid_difference, Direction=unit_z)
deconstruct_domain = DeconstructDomain(Domain=closest_points.Distance)  # -> Start, End
create_material = CreateMaterial(
    Diffuse=ColourSwatch(SwatchColor=RGB(184, 66, 66)),
    Specular=RGB(255, 255, 255),
    Emission=RGB(0, 0, 0),
    Transparency=0,
    Shine=Slider(70, range=0..100))
create_material_2 = CreateMaterial(
    Diffuse=ColourSwatch(SwatchColor=RGB(3, 15, 20)),
    Specular=RGB(255, 255, 255),
    Emission=RGB(0, 0, 0),
    Transparency=0,
    Shine=Slider(100, range=0..100))
gradient = Gradient(
    LowerLimit=deconstruct_domain.Start,
    UpperLimit=deconstruct_domain.End,
    Parameter=area_2.Centroid,
    stops=[0: RGB(48, 18, 59), 0.0294: RGB(56, 40, 112), 0.0588: RGB(63, 62, 156), 0.0882: RGB(68, 82, 193), 0.118: RGB(70, 102, 221), 0.147: RGB(71, 122, 241)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])
custom_preview = CustomPreview(Geometry=patch, Material=create_material)
custom_preview_2 = CustomPreview(Geometry=pipe, Material=create_material_2)
create_material_3 = CreateMaterial(Diffuse=gradient, Specular=RGB(255, 255, 255), Emission=RGB(0, 0, 0), Transparency=0, Shine=Slider(90, range=0..100))
create_material_4 = CreateMaterial(
    Diffuse=ColourSwatch(SwatchColor=RGB(45, 107, 161)),
    Specular=RGB(255, 255, 255),
    Emission=RGB(0, 0, 0),
    Transparency=0,
    Shine=Slider(40, range=0..100))
custom_preview_3 = CustomPreview(Geometry=patch_2, Material=create_material_3)
custom_preview_4 = CustomPreview(Geometry=extrude, Material=create_material_4)
