# Grasshopper definition 33Eni.gh (Grasshopper 1.0.8)
# plug-ins: LunchBox

sphere = Sphere(Base=PlaneXY(0, 0, 0), Radius=Slider(4, range=0..10))
quad_panels = QuadPanels(Surface=sphere, UDivisions=Slider(10, range=0..100), VDivisions=Slider(6, range=0..100))
deconstruct_brep = DeconstructBrep(Brep=quad_panels)  # -> Faces, Edges, Vertices
join_curves = JoinCurves(Curves=deconstruct_brep.Faces, Preserve=False)
graft_tree = GraftTree(Tree=join_curves, IncludeEmptyLists=True, IncludeNullItems=True)
md_slider = MDSlider(SliderMode=0, slider_value=Point(0.5, 0.5, 0.5), x_domain=Domain(0, 1), y_domain=Domain(0, 1), z_domain=Domain(0, 1))
evaluate_surface = EvaluateSurface(Surface=reparameterize(graft_tree), Point=md_slider)  # -> Point, Normal, UDirection, VDirection, Frame
brep_wireframe = BrepWireframe(Brep=graft_tree, Density=-1)
join_curves_2 = JoinCurves(Curves=brep_wireframe, Preserve=False)
offset_curve = OffsetCurve(Curve=join_curves_2, Distance=1, Plane=evaluate_surface.Frame, Corners=1)
weave = Weave(Pattern=[0, 1], Stream0=join_curves_2, Stream1=offset_curve, NullGaps=False)
series = Series(Start=0, Step=Slider(0.05, range=0..0.1), Count=Slider(20, range=0..100))
boundary_surfaces = BoundarySurfaces(Edges=weave)
negative = Negative(Value=series)
offset_curve_2 = OffsetCurve(Curve=deconstruct_brep.Faces, Distance=negative, Plane=boundary_surfaces, Corners=1)
area = Area(Geometry=sphere)  # -> Area, Centroid
area_2 = Area(Geometry=offset_curve_2)  # -> Area, Centroid
curve = Curve(simplify(offset_curve_2))
vector_2pt = Vector2Pt(PointA=simplify(graft(area.Centroid)), PointB=simplify(graft(area_2.Centroid)), Unitize=Toggle(True))  # -> Vector, Length
amplitude = Amplitude(Vector=vector_2pt.Vector, Amplitude=Slider(0.41, range=0..1))
move = Move(Geometry=offset_curve_2, Motion=amplitude)  # -> simplify(Geometry), Transform
path_mapper = PathMapper(curve, source="[A;B)", target="{A]")
path_mapper_2 = PathMapper(move.Geometry, source="[A;B)", target="{A]")
dispatch = Dispatch(List=path_mapper, DispatchPattern=[True, False])  # -> ListA, ListB
dispatch_2 = Dispatch(List=path_mapper_2, DispatchPattern=[True, False])  # -> ListA, ListB
curve_2 = Curve(dispatch.ListA)
curve_3 = Curve(dispatch_2.ListB)
weave_2 = Weave(Pattern=[0, 1], Stream0=curve_2, Stream1=curve_3, NullGaps=False)
loft = Loft(Curves=weave_2, Options={Adjust=False, Closed=False, LoftEnds=0, LoftSimp=0, LoftType=0, Rebuild=10, Refit=0.01})
create_material = CreateMaterial(
    Diffuse=ColourSwatch(SwatchColor=RGB(46, 94, 191)),
    Specular=RGB(255, 255, 255),
    Emission=RGB(0, 0, 0),
    Transparency=0,
    Shine=Slider(70, range=0..100))
custom_preview = CustomPreview(Geometry=loft, Material=create_material)
