# Grasshopper definition 34Chess.gh (Grasshopper 1.0.8)
# plug-ins: Pufferfish, LunchBox

xz_plane = XZPlane(Origin=Point(0, 0, 0))
rectangle = Rectangle(Plane=xz_plane, XSize=Slider(60, range=0..100), YSize=Slider(19.88, range=0..100), Radius=0)  # -> Rectangle, Length
quad_panels = QuadPanels(Surface=rectangle.Rectangle, UDivisions=Slider(26, range=0..100), VDivisions=Slider(7, range=0..100))
dispatch = Dispatch(List=flatten(quad_panels), DispatchPattern=[True, False])  # -> ListA, ListB
surface = Surface(dispatch.ListA)
number_slider = Slider(1.2, range=0..10)
deconstruct_brep = DeconstructBrep(Brep=surface)  # -> Faces, Edges, Vertices
list_item = ListItem(List=deconstruct_brep.Vertices, Index=0, Wrap=True)
scale_nu = ScaleNU(Geometry=graft(surface), Plane=list_item, ScaleX=number_slider, ScaleY=1, ScaleZ=number_slider)  # -> Geometry, Transform
surface_2 = Surface(scale_nu.Geometry)
deconstruct_brep_2 = DeconstructBrep(Brep=scale_nu.Geometry)  # -> Faces, Edges, Vertices
solid_union = SolidUnion(Breps=flatten(surface_2))
merge_faces = MergeFaces(Brep=flatten(solid_union))  # -> Breps, Before, After
list_item_2 = ListItem(List=deconstruct_brep_2.Vertices, Index=0, Wrap=True)  # -> Item1, Item
unit_y = UnitY(Factor=Slider(1, range=0..10.01))
curve = Curve(scale_nu.Geometry)
brep = Brep(merge_faces.Breps)
xz_plane_2 = XZPlane(Origin=Point(0, 0, 0))
move = Move(Geometry=list_item_2.Item1, Motion=unit_y)  # -> Geometry, Transform
bounding_rectangle = BoundingRectangle(Geometry=brep, Plane=xz_plane_2, Axis=0, Slide=0, Union=True)  # -> Bounding, DimensionX, DimensionY
xz_plane_3 = XZPlane(Origin=move.Geometry)
construct_point = ConstructPoint(XCoordinate=0, YCoordinate=0, ZCoordinate=0)
unit_y_2 = UnitY(Factor=1)
solid_difference = SolidDifference(BrepsA=graft(bounding_rectangle.Bounding), BrepsB=flatten(brep))
rotate = Rotate(Geometry=xz_plane_3, Angle=degrees(Slider(15, range=0..360)), Plane=move.Geometry)  # -> Geometry, Transform
curve_2 = Curve(solid_difference)
project_along = ProjectAlong(Geometry=curve, Plane=rotate.Geometry, Direction=unit_y_2)  # -> Geometry, Transform
negative = Negative(Value=Slider(0.1, range=0..0.1))
expression = Expression(x=bounding_rectangle.DimensionX, Expression="x/(2*π)")
unit_x = UnitX(Factor=1)
offset_curve = OffsetCurve(Curve=curve_2, Distance=negative, Plane=curve_2, Corners=1)
merge = Merge(Data1=simplify(graft(curve)), Data2=simplify(graft(project_along.Geometry)))
subtraction = Subtraction(A=expression, B=Slider(2, range=0..10))
loft = Loft(Curves=merge, Options={Adjust=False, Closed=False, LoftEnds=0, LoftSimp=0, LoftType=0, Rebuild=10, Refit=0.01})
solid_difference_2 = SolidDifference(BrepsA=graft(curve_2), BrepsB=flatten(offset_curve))
unit_y_3 = UnitY(Factor=subtraction)
circle = Circle(Plane=PlaneXY(0, 0, 0), Radius=expression)
boolean_toggle = BooleanToggle(True)
unit_y_4 = UnitY(Factor=Slider(1, range=0..10))
negative_2 = Negative(Value=unit_y_3)
cap_holes = CapHoles(Brep=loft)
extrude = Extrude(Base=solid_difference_2, Direction=negative_2)
extrude_2 = Extrude(Base=solid_difference_2, Direction=unit_y_4)
line_sdl = LineSDL(Start=construct_point, Direction=unit_x, Length=bounding_rectangle.DimensionX)
flow = Flow(
    Geometry=extrude,
    Base=line_sdl,
    Target=circle,
    ReverseBase=boolean_toggle,
    ReverseTarget=False,
    Stretch=True,
    Rigid=False)
flow_2 = Flow(
    Geometry=extrude_2,
    Base=line_sdl,
    Target=circle,
    ReverseBase=boolean_toggle,
    ReverseTarget=False,
    Stretch=True,
    Rigid=False)
flow_3 = Flow(
    Geometry=cap_holes,
    Base=line_sdl,
    Target=circle,
    ReverseBase=boolean_toggle,
    ReverseTarget=False,
    Stretch=True,
    Rigid=False)
create_material = CreateMaterial(
    Diffuse=ColourSwatch(SwatchColor=RGB(116, 237, 148)),
    Specular=RGB(255, 255, 255),
    Emission=RGB(0, 0, 0),
    Transparency=0,
    Shine=Slider(80, range=0..100))
create_material_2 = CreateMaterial(
    Diffuse=ColourSwatch(SwatchColor=RGB(157, 116, 237)),
    Specular=RGB(255, 255, 255),
    Emission=RGB(0, 0, 0),
    Transparency=0,
    Shine=Slider(80, range=0..100))
custom_preview = CustomPreview(Geometry=flow_3, Material=create_material)
custom_preview_2 = CustomPreview(Geometry=[flow_2, flow], Material=create_material_2)
